# Grasshopper definition 00_frame_and_transformation.ghx (Grasshopper 1.0.7)

# ---- group: transform box from frame world XY to frame
crv = Curve(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)
crv_2 = Curve(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)
pt = Point(Point(-11.25160869, 22.08724197, 25.91983455))
vec = Vector(crv)
vec_2 = Vector(crv_2)
python = GhPythonScript(pt1=pt, vecx1=vec, vecy1=vec_2)  # -> out, box_in_frame_1, box_in_frame_2
# ---------- python: Python ----------
"""Example: Bring a box from the world coordinate system into another coordinate system.
"""
from compas.geometry import Frame
from compas.geometry import Transformation
from compas.geometry import Box

from compas_ghpython.artists import MeshArtist
from compas.datastructures.mesh import Mesh
import Rhino.Geometry as rg



# Box in Frame 1
F1 = Frame.worldXY()
width, length, height = 10, 10, 10
box = Box(F1, width, length, height)

# Convert to compas mesh
mesh = Mesh.from_vertices_and_faces(box.vertices, box.faces)
mesh_artist = MeshArtist(mesh)
box_in_frame_1 = mesh_artist.draw_mesh()

# Frame 2
F2 = Frame(pt1, vecx1, vecy1)

T = Transformation.from_frame(F2)
mesh.transform(T)
# Represent box frame in frame F2 and costruct new box
#box_frame_transformed = F2.to_world_coordinates(box.frame)
#box_transformed = Box(box_frame_transformed, width, length, height)
#print("Box frame transformed", box_transformed.frame)
#
#mesh = Mesh.from_vertices_and_faces(box_transformed.vertices, box_transformed.faces)
mesh_artist = MeshArtist(mesh)
box_in_frame_2 = mesh_artist.draw_mesh()
# ---------- end python ----------
mesh = Mesh(python.box_in_frame_1)
mesh_2 = Mesh(python.box_in_frame_2)

# ---- group: frame construction
pln = Plane(Plane(origin=(-11.25160869, 22.08724197, 25.91983455), x=(0.7495005578, -0.5910962845, 0.2980840425), y=(0.5492517264, 0.8066010058, 0.2184430328)))
python_2 = GhPythonScript(ind=Slider(5, range=0..6), plane_rg=pln)  # -> out, planeF_rg
# ---------- python_2: Python ----------
"""There are several ways to construst a `Frame`.
"""
from compas.geometry import Point
from compas.geometry import Vector
from compas.geometry import Frame
from compas.geometry import Plane

from compas_ghpython import draw_frame

import Rhino.Geometry as rg

if ind == 0:
    F = Frame(Point(1, 0, 0), Vector(-0.45, 0.1, 0.3), Vector(1, 0, 0))
    print("Frame from compas point and vectors: ")
elif ind == 1:
    F = Frame([1, 0, 0], [-0.45, 0.1, 0.3], [1, 0, 0])
    print("Frame from point, x-axis and y-axis as list: ")
elif ind == 2:
    F = Frame.from_points([1, 1, 1], [2, 3, 6], [6, 3, 0])
    print("Frame from three points as list: ")
elif ind == 3:
    F = Frame.from_plane(Plane([0, 0, 0], [0.5, 0.2, 0.1]))
    print("Frame from compas plane: ")
elif ind == 4:
    F = Frame.from_euler_angles([0.5, 1., 0.2])
    print("Frame from euler angles: ")
elif ind == 5:
    F = Frame.worldXY()
    print("World XY frame")
elif ind == 6:
    F = F = Frame(plane_rg.Origin, plane_rg.XAxis, plane_rg.YAxis)
    print("Frame from Rhino plane:")

print(F)

#planeF = rg.Plane(rg.Point3d(F[0][0], F[0][1], F[0][2]), rg.Vector3d(F[1][0], F[1][1], F[1][2]), rg.Vector3d(F[2][0], F[2][1], F[2][2]))
planeF_rg = draw_frame(F)
# ---------- end python_2 ----------
panel = Panel(python_2.out)
pln_2 = Plane(python_2.planeF_rg)

# ---- group: transform box from frame to frame
crv_3 = Curve(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)
crv_4 = Curve(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)
crv_5 = Curve(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)
crv_6 = Curve(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)
pt_2 = Point(Point(-11.25160869, 22.08724197, 25.91983455))
vec_3 = Vector(crv_3)
vec_4 = Vector(crv_4)
pt_3 = Point(Point(57.6759268, -31.86215913, 32.87035713))
vec_5 = Vector(crv_5)
vec_6 = Vector(crv_6)
python_3 = GhPythonScript(pt1=pt_2, vecx1=vec_3, vecy1=vec_4, pt2=pt_3, vecx2=vec_5, vecy2=vec_6)  # -> out, box_in_frame_1, box_in_frame_2
# ---------- python_3: Python ----------
"""Example: Bring a box from the world coordinate system into another coordinate system.
"""
from compas.geometry import Frame
from compas.geometry import Transformation
from compas.geometry import Box

from compas_ghpython.artists import MeshArtist
from compas.datastructures.mesh import Mesh
import Rhino.Geometry as rg

from compas_ghpython import draw_mesh



# Box in Frame 1
F1 = Frame(pt1, vecx1, vecy1)
width, length, height = 10, 10, 10
box = Box(F1, width, length, height)

# Draw mesh
mesh = Mesh.from_vertices_and_faces(box.vertices, box.faces)
mesh_artist = MeshArtist(mesh)
box_in_frame_1 = mesh_artist.draw_mesh()
#box_in_frame_1 = draw_mesh(box.vertices, box.faces)

# Frame 2
F2 = Frame(pt2, vecx2, vecy2)

# Represent box frame in frame F2 and costruct new box
box_frame_transformed = F2.to_world_coordinates(box.frame)
box_transformed = Box(box_frame_transformed, width, length, height)
print("Box frame transformed", box_transformed.frame)

WTF2 = Transformation.from_change_of_basis(F2, Frame.worldXY())
mesh2 = mesh.transformed(WTF2)
mesh_artist2 = MeshArtist(mesh2)
box_in_frame_2 = mesh_artist2.draw_mesh()

# Draw mesh
mesh = Mesh.from_vertices_and_faces(box_transformed.vertices, box_transformed.faces)
mesh_artist = MeshArtist(mesh)
#box_in_frame_2 = mesh_artist.draw_mesh()
# ---------- end python_3 ----------
mesh_3 = Mesh(python_3.box_in_frame_1)
mesh_4 = Mesh(python_3.box_in_frame_2)

# ---- group: frame in frame
crv_7 = Curve(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)
crv_8 = Curve(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)
crv_9 = Curve(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)
crv_10 = Curve(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)
pt_4 = Point(Point(-11.25160869, 22.08724197, 25.91983455))
vec_7 = Vector(crv_7)
vec_8 = Vector(crv_8)
pt_5 = Point(Point(57.6759268, -31.86215913, 32.87035713))
vec_9 = Vector(crv_9)
vec_10 = Vector(crv_10)
python_4 = GhPythonScript(pt1=pt_4, vecx1=vec_7, vecy1=vec_8, pt2=pt_5, vecx2=vec_9, vecy2=vec_10)  # -> out, F1_rg, F2_local_rg, F2_world_rg
# ---------- python_4: Python ----------
"""Example: 'frame in frame'
"""
from compas.geometry import Point
from compas.geometry import Vector
from compas.geometry import Frame

from compas_ghpython.utilities import draw_frame

import Rhino.Geometry as rg


# Frame 1
point = pt1
xaxis = vecx1
yaxis = vecy1
F1 = Frame(point, xaxis, yaxis)

# Frame 2, local
point = pt2
xaxis = vecx2
yaxis = vecy2
F2 = Frame(point, xaxis, yaxis)

# Frame 2 in Frame 1, represented in global (world) coordinate system
F2_world = F1.to_world_coordinates(F2)
print(F2_world)


# check
F2_local = F1.to_local_coordinates(F2_world)
print(F2_local)


print(F2 == F2_local)

F1_rg = draw_frame(F1)
F2_local_rg = draw_frame(F2_local)
F2_world_rg = draw_frame(F2_world)
# ---------- end python_4 ----------
pln_3 = Plane(python_4.F2_world_rg)
pln_4 = Plane(python_4.F2_local_rg)

# ---- group: frames as coordinate systems
crv_11 = Curve(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)
crv_12 = Curve(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)
pt_6 = Point(Point(-11.25160869, 22.08724197, 25.91983455))
vec_11 = Vector(crv_12)
vec_12 = Vector(crv_11)
python_5 = GhPythonScript(pt1=pt_6, vecx=vec_11, vecy=vec_12)  # -> out, pt_world, pt_local
# ---------- python_5: Python ----------
"""Example: 'point in frame'
"""
from compas.geometry import Point
from compas.geometry import Vector
from compas.geometry import Frame
#from compas_ghpython.utilities import draw_points

import Rhino.Geometry as rg
    
def draw_point(point):
    """Draw point.
    """
    pos = point.data
    return rg.Point3d(*pos)

point = pt1
xaxis = vecx
yaxis = vecy

# coordinate system F
F = Frame(point, xaxis, yaxis)

# point in F (local coordinates)
P_local = Point(15., 15., 15.) # point in frame

# point in global (world) coordinates
P_world = F.to_world_coordinates(P_local)
print(P_world)


# check
P_local_check = F.to_local_coordinates(P_world)
print(P_local_check)

pt_world = draw_point(P_world)
pt_local = draw_point(P_local_check)
# ---------- end python_5 ----------
pt_7 = Point(python_5.pt_world)
pt_8 = Point(python_5.pt_local)

# ----
# FRAMES
pln_5 = Plane(python_4.F1_rg)

# ---- group: transformation between two frames
crv_13 = Curve(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)
crv_14 = Curve(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)
crv_15 = Curve(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)
crv_16 = Curve(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)
vec_13 = Vector(crv_14)
vec_14 = Vector(crv_15)
pt_9 = Point(Point(57.6759268, -31.86215913, 32.87035713))
vec_15 = Vector(crv_13)
vec_16 = Vector(crv_16)
pt_10 = Point(Point(-11.25160869, 22.08724197, 25.91983455))
python_6 = GhPythonScript(pt1=pt_10, vecx1=vec_13, vecy1=vec_14, pt2=pt_9, vecx2=vec_15, vecy2=vec_16)  # -> out, F1_rg, F2_rg, nc
# ---------- python_6: Python ----------
"""This example computes a change of basis transformation between two frames F1 and F2.
A basis change is essentially a remapping of geometry from one coordinate system to another.
"""

from compas.geometry import Frame
from compas.geometry import Transformation
from compas_ghpython.utilities import draw_frame

F1 = Frame(pt1, vecx1, vecy1)
F2 = Frame(pt2, vecx2, vecy2)

T = Transformation.from_frame_to_frame(F1, F2)

print("Transformation between F1 and F2: ")
print(T)

F1_rg = draw_frame(F1)
F2_rg = draw_frame(F2)

import Rhino.Geometry as rg


pts = [F1_rg.Origin, F1_rg.Origin+F1_rg.ZAxis*50, F2_rg.Origin+F2_rg.ZAxis*50, F2_rg.Origin]
T_curve = rg.PolylineCurve(pts)

nc = rg.NurbsCurve(3, len(pts))
nc = rg.NurbsCurve.Create(False, 3, pts)
# ---------- end python_6 ----------
panel_2 = Panel(python_6.out)

# ---- group: transform box using T
crv_17 = Curve(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)
crv_18 = Curve(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)
crv_19 = Curve(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)
crv_20 = Curve(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)
pt_11 = Point(Point(57.6759268, -31.86215913, 32.87035713))
pt_12 = Point(Point(-11.25160869, 22.08724197, 25.91983455))
vec_17 = Vector(crv_18)
vec_18 = Vector(crv_19)
vec_19 = Vector(crv_17)
vec_20 = Vector(crv_20)
python_7 = GhPythonScript(pt1=pt_12, vecx1=vec_17, vecy1=vec_18, pt2=pt_11, vecx2=vec_19, vecy2=vec_20)  # -> out, box_in_frame_1, box_in_frame_2
# ---------- python_7: Python ----------
"""Example: Bring a box from the world coordinate system into another coordinate system.
"""
from compas.geometry import Frame
from compas.geometry import Transformation
from compas.geometry import Box
from compas.datastructures.mesh import Mesh
from compas_ghpython.artists import MeshArtist


# Box in the world coordinate system
F1 = Frame(pt1, vecx1, vecy1)
width, length, height = 10, 10, 10
box = Box(F1, width, length, height)
mesh = Mesh.from_vertices_and_faces(box.vertices, box.faces)
mesh_artist = MeshArtist(mesh)
box_in_frame_1 = mesh_artist.draw_mesh()

# Frame F representing a coordinate system
F2 = Frame(pt2, vecx2, vecy2)

# Get transformation between frames and apply transformation on box.
T = Transformation.from_frame(F2)
print(T)
box_in_frame_2 = box.transformed(T)

print("Box frame transformed", box_in_frame_2.frame)
mesh = Mesh.from_vertices_and_faces(box_in_frame_2.vertices, box_in_frame_2.faces)
mesh_artist = MeshArtist(mesh)
box_in_frame_2 = mesh_artist.draw_mesh()
# ---------- end python_7 ----------
mesh_5 = Mesh(python_7.box_in_frame_1)
mesh_6 = Mesh(python_7.box_in_frame_2)

# ----
# TRANSFORMATIONS
pln_6 = Plane(python_6.F1_rg)
pln_7 = Plane(python_6.F2_rg)
crv_21 = Curve(python_6.nc)

panel_3 = Panel(python_7.out)

# ---- group: frames representation
crv_22 = Curve(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)
crv_23 = Curve(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)
pt_13 = Point(Point(-11.25160869, 22.08724197, 25.91983455))
vec_21 = Vector(crv_22)
vec_22 = Vector(crv_23)
python_8 = GhPythonScript(pt1=pt_13, vecx=vec_21, vecy=vec_22)  # -> out, point
# ---------- python_8: Python ----------
"""Example: 'point in frame'
"""
from compas.geometry import Point
from compas.geometry import Vector
from compas.geometry import Frame
#from compas_ghpython.utilities import draw_points

import Rhino.Geometry as rg
    
def draw_point(point):
    """Draw point.
    """
    pos = point.data
    return rg.Point3d(*pos)

point = pt1
xaxis = vecx
yaxis = vecy

# coordinate system F
F = Frame(point, xaxis, yaxis)

point = draw_point(F.point)

axis_angle_vector = F.axis_angle_vector
print("UR robots: axis angle vector: ")
print(axis_angle_vector)

euler_angles = F.euler_angles(static=True, axes='xyz') 
print("KUKA robots: euler_angles: ")
print(euler_angles)

quaternion = F.quaternion
print("ABB robots: quaternion")
print(quaternion)
# ---------- end python_8 ----------
pt_14 = Point(python_8.point)
panel_4 = Panel(python_8.out)

# ---- group: euler angles
gamma = Slider(3.14, range=-3.14..3.14)
python_9 = GhPythonScript(alpha=Slider(1.73, range=-3.14..3.14), beta=Slider(-2.88, range=-3.14..3.14), gamma=gamma)  # -> out, plane, box_transf
# ---------- python_9: Python ----------
"""Example: Rotations from euler angles, rotate an object based on 3 euler angles.
"""

import compas
from compas.geometry import Frame
from compas.geometry import Rotation
from compas.datastructures import Mesh
from compas.datastructures import mesh_transform
from compas.geometry import Box
from compas_ghpython.utilities import draw_frame
from compas_ghpython.artists import MeshArtist

# euler angles
#alpha, beta, gamma = -0.156, -0.274, 0.785
static, axes = True, 'xyz'

# Version 1: Create Rotation from angles
R1 = Rotation.from_euler_angles([alpha, beta, gamma], static, axes)

# Version 2: Concatenate 3 Rotations
xaxis, yaxis, zaxis = [1, 0, 0], [0, 1, 0], [0, 0, 1]
Rx = Rotation.from_axis_and_angle(xaxis, alpha)
Ry = Rotation.from_axis_and_angle(yaxis, beta)
Rz = Rotation.from_axis_and_angle(zaxis, gamma)
 
if static: # check order!
    R2 = Rz * Ry * Rx
else:
    R2 = Rx * Ry * Rz

# Check
print(R1 == R2)

# Transform box
box = Box.from_width_height_depth(10, 10, 10)
box.transform(R1)

F = box.frame
plane = draw_frame(F)

mesh = Mesh.from_vertices_and_faces(box.vertices, box.faces)
m_b = MeshArtist(mesh)
box_transf = m_b.draw()
# ---------- end python_9 ----------

# ---- group: axis angles
theta = Slider(-0.92, range=-3.14..3.14)
crv_24 = Curve(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)
crv_25 = Curve(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)
vec_23 = Vector(crv_25)
pt_15 = Point(Point(-11.25160869, 22.08724197, 25.91983455))
vec_24 = Vector(crv_24)
python_10 = GhPythonScript(pt1=pt_15, vecx=vec_24, vecy=vec_23, theta=theta)  # -> out, plane, box_transf
# ---------- python_10: Python ----------
"""Example: Rotations from axis angle representation, rotate an object based on 3 euler angles.
"""

import math
from compas.geometry import Frame
from compas.geometry import Rotation
from compas.geometry import Box
from compas.datastructures.mesh import Mesh
from compas_ghpython.utilities import draw_frame
from compas_ghpython.artists import MeshArtist

#theta = math.radians(30)
R = Rotation.from_axis_and_angle((1,0,0), theta)
print(R)




box = Box.from_width_height_depth(10, 10, 10)

"""

f1 = Frame(pt1, vecx, vecy)
R = Rotation.from_frame(f1)

args = False, 'xyz'
alpha, beta, gamma = R.euler_angles(*args)
print("euler angles = ", alpha, beta, gamma)
xaxis, yaxis, zaxis = [1, 0, 0], [0, 1, 0], [0, 0, 1]
Rx = Rotation.from_axis_and_angle(xaxis, alpha)
Ry = Rotation.from_axis_and_angle(yaxis, beta)
Rz = Rotation.from_axis_and_angle(zaxis, gamma)
f2 = Frame.worldXY()
#f1 == f2.transform(Rx * Ry * Rz)


# Transform box

box.transform(Rx * Ry * Rz)
"""

box.transform(R)
F = box.frame
plane = draw_frame(F)

mesh = Mesh.from_vertices_and_faces(box.vertices, box.faces)
mesh_artist = MeshArtist(mesh)
box_transf = mesh_artist.draw_mesh()
# ---------- end python_10 ----------
panel_5 = Panel(python_10.out)
mesh_7 = Mesh(python_10.box_transf)

# ---- group: quaternions
q4 = Slider(-0.545, range=-1..1)
python_11 = GhPythonScript(q1=Slider(-0.347, range=-1..1), q2=Slider(0.22, range=-1..1), q3=Slider(-0.023, range=-1..1), q4=q4)  # -> out, plane, box_transf
# ---------- python_11: Python ----------
"""Example: Rotations from quaternion representation.
"""

import math
from compas.geometry import Frame
from compas.geometry import Rotation
from compas.geometry import Box
from compas.datastructures.mesh import Mesh
from compas_ghpython.utilities import draw_frame
from compas_ghpython.artists import MeshArtist


# Quaternion input for the Rotation matrix
quaternion_a = [q1, q2, q3, q4]
R = Rotation.from_quaternion(quaternion_a)

# The basis vectors from the Rotation matrix
xaxis, yaxis = R.basis_vectors
print(xaxis)
print(yaxis)

# A frame created with the basis vectors of 
f1 = Frame([0,0,0], xaxis, yaxis)
R = Rotation.from_frame(f1)

quaternion_b = R.quaternion
print(quaternion_b)

print("quaternion_a ==", [round(val, 3) for val in quaternion_b])

# Transform box
box = Box.from_width_height_depth(10, 10, 10)
box.transform(R)

F = box.frame
plane = draw_frame(F)

mesh = Mesh.from_vertices_and_faces(box.vertices, box.faces)
m_b = MeshArtist(mesh)
box_transf = m_b.draw()
# ---------- end python_11 ----------

# ----
# FRAME REPRESENTATION
mesh_8 = Mesh(python_9.box_transf)
