# Grasshopper definition draw_dendrites_from_image.gh (Grasshopper 0.9.76)
# plug-ins: Python Interpreter

# ----
# . . . . . . . . . . . . . . . . . . . . .
# .                                       .
# .    <<      ><      ><       >< <<     .
# .    < ><   ><<     ><<<    ><    ><<   .
# .    << >< > ><    ><  ><     ><        .
# .    <<  ><  ><   ><<<<<><      ><      .
# .    <<      >< ><<     ><< ><    ><<   .
# .    <<      ><><<       ><<  >< <<     .
# .                                       .
# .             DFAB 2016/17              .
# . . . . . . . . . . . . . . . . . . . . .
# 
# Created on 28.09.2016
# 
# @author: kathrind
# Unload here if
# mas_lib was updated
unload_mas_lib = Button()
py = PythonScript(unload=unload_mas_lib)
# ---------- py: Python ----------
from mas_lib.useful import reload_mas_lib

if unload:
    reload_mas_lib()
# ---------- end py ----------

py_2 = PythonScript()  # -> path, mas_lib_path
# ---------- py_2: Python ----------
import sys, os
import Grasshopper as gh

ghComp = ghenv.Component
ghDoc = ghComp.OnPingDocument()

# the full path of the gh file
path = ghDoc.FilePath
# the directory of the gh file
path = os.path.dirname(path)

mas_lib_idx = path.find("mas_lib")
mas_lib_path = path[:(mas_lib_idx + len("mas_lib"))]
# ---------- end py_2 ----------
panel = Panel(py_2.mas_lib_path)
panel_2 = Panel(py_2.path)
py_3 = PythonScript(mas_lib_path=py_2.mas_lib_path, relative_file="algorithms\dendrite_system\food\deer.jpg")  # -> file_fullpath
# ---------- py_3: Python ----------
import os

file = os.path.join(mas_lib_path, relative_file)

assert(os.path.isfile(file))

file_fullpath = file
# ---------- end py_3 ----------
init = Button()
dendrites = PythonScript(init=init, image_file=py_3, num_init_nodes=Slider(20, range=0..50))  # -> out, ds, cmesh, sources, init_nodes; inputs num_init_nodes: Int32
# ---------- dendrites: Python ----------
from mas_lib.algorithms.dendrite_system.dendrite_sys_from_image import DendriteSystemImg

step, black_value = (20, 30)
#step, black_value = (100, 100)
thresh_nodes = 180

ds = DendriteSystemImg(image_file, step, black_value, num_init_nodes, thresh_nodes)
cmesh = ds.cmesh
sources = ds.sources
init_nodes = [node.position for node in ds.nodes]
# ---------- end dendrites ----------
mesh = Mesh(dendrites.cmesh)
step = Button()
preview = CustomPreview(Geometry=dendrites.init_nodes, Shader=ColourSwatch(SwatchColor=RGB(26, 60, 69)))
python = PythonScript(ds=dendrites.ds, step=step)  # -> out, nodes, active_nodes, radius, sources
# ---------- python: Python ----------
import Rhino.Geometry as rg
import ghpythonlib.components as ghcomp


sources = ds.sources
nodes = [node.position for node in ds.nodes] 
radius = [node.node_size*2 for node in ds.nodes]

active_nodes = [n.position for n in ds.nodes if n.active == True]
#print radius

if step:

    ds.step()
# ---------- end python ----------
cir = Circle(Plane=python.nodes, Radius=python.radius)
boundary = BoundarySurfaces(Edges=cir)
cloud = CloudDisplay(Points=python.nodes, Colours=RGB(255, 20, 147), Size=Slider(1, range=0..10), SpriteType=0)
preview_2 = CustomPreview(Geometry=boundary, Shader=ColourSwatch(SwatchColor=RGB(19, 56, 66)))
cir_2 = Circle(Plane=python.active_nodes, Radius=10)
preview_3 = CustomPreview(Geometry=cir_2, Shader=ColourSwatch(SwatchColor=RGB(28, 206, 255)))
