# Grasshopper definition 160929_radom_walk_examples_DJ.gh (Grasshopper 0.9.76)
# plug-ins: Python Interpreter

list = ValueList({"simple_random_walk": "simple_random_walk ", "step_random_walk"}, selected="step_random_walk")  # disabled
list_2 = ValueList({"points", "lines", "control_pt_curve", "interpolated_curve"}, selected="control_pt_curve")  # disabled
seed = Slider(67799986, range=0..100000000)  # disabled
number_slider = Slider(600, range=0..1000)  # disabled
number_slider_2 = Slider(400, range=0..1000)  # disabled
iterations = Slider(146, range=0..1000)  # disabled
z_offset = Slider(20, range=0..100)  # disabled
margin = Slider(20, range=0..100)  # disabled
crv_div = Slider(45, range=0..100)  # disabled
x_step = Slider(30, range=0..100)  # disabled
y_step = Slider(20, range=0..100)  # disabled

# ---- group: simple_random_walk
number_slider_3 = Slider(600, range=0..1000)  # disabled
number_slider_4 = Slider(400, range=0..1000)  # disabled
seed_2 = Slider(32543989, range=0..100000000)  # disabled
iterations_2 = Slider(338, range=0..1000)  # disabled
random_walk = PythonScript(SEED=seed_2, x_size=number_slider_3, y_size=number_slider_4, iterations=iterations_2)  # -> out, points, lines, interpolated_curve, control_pt_curve; inputs x_size: Int32, y_size: Int32, iterations: Int32; disabled
# ---------- random_walk: Python ----------
import Rhino.Geometry as rg

import random as r
r.seed(_SEED)

points = []
lines = []

for i in range(iterations):
    temp_x = r.randint(0, x_size)
    temp_y = r.randint(0, y_size)
    
    temp_pt = rg.Point3d(temp_x, temp_y, 0)
    points.append(temp_pt)

for i,pt in enumerate(points):
    if i < len(points) - 1:
        temp_line = rg.Line(pt, points[i+1])
        lines.append(temp_line)


interpolated_curve = rg.Curve.CreateInterpolatedCurve(points, 3)
control_pt_curve= rg.Curve.CreateControlPointCurve(points, 3)
# ---------- end random_walk ----------
points = Geometry(random_walk.points)  # disabled
lines = Geometry(random_walk.lines)  # disabled
interpolated_curve = Geometry(random_walk.interpolated_curve)  # disabled
control_pt_curve = Geometry(random_walk.control_pt_curve)  # disabled

# ----
z_depth_value = Slider(5, range=0..10)  # disabled
toggle = BooleanToggle(True)  # disabled
list_3 = ValueList({"simple_random_walk": "simple_random_walk ", "step_random_walk"}, selected="step_random_walk")  # disabled
list_4 = ValueList({"points", "lines", "control_pt_curve", "interpolated_curve"}, selected="interpolated_curve")  # disabled
seed_3 = Slider(34999996, range=0..100000000)  # disabled
number_slider_5 = Slider(600, range=0..1000)  # disabled
number_slider_6 = Slider(400, range=0..1000)  # disabled
iterations_3 = Slider(978, range=0..1000)  # disabled
z_offset_2 = Slider(20, range=0..100)  # disabled
margin_2 = Slider(30, range=0..100)  # disabled
y_step_2 = Slider(20, range=0..100)  # disabled
crv_div_2 = Slider(45, range=0..100)  # disabled
x_step_2 = Slider(37, range=0..100)  # disabled

# ---- group: step_random_walk
iterations_4 = Slider(1120, range=0..5000)
seed_4 = Slider(63143979, range=0..100000000)
step_random_walk = PythonScript(SEED=seed_4, x_size=Slider(600, range=0..1000), y_size=Slider(400, range=0..1000), iterations=iterations_4)  # -> out, points, lines, interpolated_curve, control_pt_curve; inputs x_size: Int32, y_size: Int32, iterations: Int32
# ---------- step_random_walk: Python ----------
import Rhino.Geometry as rg

import random as r
r.seed(_SEED)

points = []
lines = []

x_step = 30
y_step = 20
margin = 20

temp_x = r.randint(0, x_size)
temp_y = r.randint(0, y_size)

start_pt = rg.Point3d(temp_x, temp_y, 0)
points.append(start_pt)

for i in range(iterations):
    temp_x = r.randint(-x_step, x_step)
    temp_y = r.randint(-y_step, y_step)
    
    temp_vec = rg.Vector3d(temp_x, temp_y, 0)
    temp_pt = points[-1] + temp_vec
    
    """
    if temp_pt.X < margin or temp_pt.X > x_size - margin:
        temp_pt = points[r.randint(0, len(points))]
    if temp_pt.Y < margin or temp_pt.Y > y_size - margin:
        temp_pt = points[r.randint(0, len(points))]
    """
    
    if temp_pt.X < margin or temp_pt.X > x_size - margin:
        temp_pt = points[-1] + rg.Vector3d(-2 * temp_vec.X, 0, 0)
    if temp_pt.Y < margin or temp_pt.Y > y_size - margin:
        temp_pt = points[-1] + rg.Vector3d(0, -2 * temp_vec.Y, 0)
    
    points.append(temp_pt)

for i,pt in enumerate(points):
    if i < len(points) - 1:
        temp_line = rg.Line(pt, points[i+1])
        lines.append(temp_line)


interpolated_curve = rg.Curve.CreateInterpolatedCurve(points, 3)
control_pt_curve= rg.Curve.CreateControlPointCurve(points, 3)
# ---------- end step_random_walk ----------
points_2 = Geometry(step_random_walk.points)
lines_2 = Geometry(step_random_walk.lines)
interpolated_curve_2 = Geometry(step_random_walk.interpolated_curve)
control_pt_curve_2 = Geometry(step_random_walk.control_pt_curve)

# ----
seed_5 = Slider(45955559.26, range=0..100000000)
list_5 = ValueList({"points", "lines"}, selected="lines")

# ---- group: simple_random_walk
seed_6 = Slider(32543989, range=0..100000000)
iterations_5 = Slider(85, range=0..1000)
random_walk_2 = PythonScript(SEED=seed_6, x_size=Slider(600, range=0..1000), y_size=Slider(400, range=0..1000), iterations=iterations_5)  # -> out, points, lines, interpolated_curve, control_pt_curve; inputs x_size: Int32, y_size: Int32, iterations: Int32
# ---------- random_walk_2: Python ----------
import Rhino.Geometry as rg

import random as r
r.seed(_SEED)

points = []
lines = []

























for i in range(iterations):
    temp_x = r.randint(0, x_size)
    temp_y = r.randint(0, y_size)
    
    temp_pt = rg.Point3d(temp_x, temp_y, 0)
    points.append(temp_pt)

for i,pt in enumerate(points):
    if i < len(points) - 1:
        temp_line = rg.Line(pt, points[i+1])
        lines.append(temp_line)


interpolated_curve = rg.Curve.CreateInterpolatedCurve(points, 3)
control_pt_curve= rg.Curve.CreateControlPointCurve(points, 3)
# ---------- end random_walk_2 ----------
points_3 = Geometry(random_walk_2.points)
lines_3 = Geometry(random_walk_2.lines)
interpolated_curve_3 = Geometry(random_walk_2.interpolated_curve)
control_pt_curve_3 = Geometry(random_walk_2.control_pt_curve)

# ----
random_walk_3 = PythonScript(
    type=list,
    selection=list_2,
    SEED=seed,
    x_size=number_slider,
    y_size=number_slider_2,
    iterations=iterations,
    z_offset=z_offset,
    margin=margin,
    crv_div=crv_div,
    x_step=x_step,
    y_step=y_step)  # -> out, paper_size, geom, planes, path; inputs x_size: Int32, y_size: Int32, iterations: Int32, z_offset: Int32, x_step: Int32, y_step: Int32; disabled
# ---------- random_walk_3: Python ----------
import Rhino.Geometry as rg
import rhinoscriptsyntax as rs

import random as r
r.seed(_SEED)

paper_size = rg.Rectangle3d(rg.Plane(rg.Point3d(0,0,0),rg.Vector3d.ZAxis),600,400)

points = []
lines = []

if _type == "simple_random_walk ":
    for i in range(iterations):
        temp_x = r.randint(margin, x_size - margin)
        temp_y = r.randint(margin, y_size - margin)
        
        temp_pt = rg.Point3d(temp_x, temp_y, 0)
        points.append(temp_pt)

elif _type == "step_random_walk":
    temp_x = r.randint(0, x_size)
    temp_y = r.randint(0, y_size)
    
    start_pt = rg.Point3d(temp_x, temp_y, 0)
    points.append(start_pt)
    
    for i in range(iterations):
        temp_x = r.randint(-x_step, x_step)
        temp_y = r.randint(-y_step, y_step)
        
        temp_vec = rg.Vector3d(temp_x, temp_y, 0)
        temp_pt = points[-1] + temp_vec
        
        """
        if temp_pt.X < margin or temp_pt.X > x_size - margin:
            temp_pt = points[r.randint(0, len(points)-1)]
        if temp_pt.Y < margin or temp_pt.Y > y_size - margin:
            temp_pt = points[r.randint(0, len(points)-1)]
        """
        
        if temp_pt.X < margin or temp_pt.X > x_size - margin:
            temp_pt = points[-1] + rg.Vector3d(-2 * temp_vec.X, 0, 0)
        if temp_pt.Y < margin or temp_pt.Y > y_size - margin:
            temp_pt = points[-1] + rg.Vector3d(0, -2 * temp_vec.Y, 0)
        
        points.append(temp_pt)

for i,pt in enumerate(points):
    if i < len(points) - 1:
        temp_line = rg.Line(pt, points[i+1])
        lines.append(temp_line)

if _selection == "points":
    geom = points
    planes = []
    for pt in points:
        planes.append(rg.Plane(pt+rg.Vector3d(0,0,z_offset),rg.Vector3d.ZAxis))
        planes.append(rg.Plane(pt,rg.Vector3d.ZAxis))
    planes.append(rg.Plane(pt+rg.Vector3d(0,0,z_offset),rg.Vector3d.ZAxis))
elif _selection == "lines":
    geom = lines
    planes = []
    planes.append(rg.Plane(points[0]+rg.Vector3d(0,0,z_offset),rg.Vector3d.ZAxis))
    for pt in points:
        planes.append(rg.Plane(pt,rg.Vector3d.ZAxis))
    planes.append(rg.Plane(pt+rg.Vector3d(0,0,z_offset),rg.Vector3d.ZAxis))
elif _selection == "control_pt_curve":
    geom = rg.Curve.CreateControlPointCurve(points, 3)
    planes = []
    points = geom.DivideByCount(crv_div,True)
    points = [rs.EvaluateCurve(geom, t) for t in points]
    planes.append(rg.Plane(points[0]+rg.Vector3d(0,0,z_offset),rg.Vector3d.ZAxis))
    for pt in points:
        planes.append(rg.Plane(pt,rg.Vector3d.ZAxis))
    planes.append(rg.Plane(pt+rg.Vector3d(0,0,z_offset),rg.Vector3d.ZAxis))
elif _selection == "interpolated_curve":
    geom = rg.Curve.CreateInterpolatedCurve(points, 3)
    planes = []
    points = geom.DivideByCount(crv_div,True)
    points = [rs.EvaluateCurve(geom, t) for t in points]
    planes.append(rg.Plane(points[0]+rg.Vector3d(0,0,z_offset),rg.Vector3d.ZAxis))
    for pt in points:
        planes.append(rg.Plane(pt,rg.Vector3d.ZAxis))
    planes.append(rg.Plane(pt+rg.Vector3d(0,0,z_offset),rg.Vector3d.ZAxis))

path_pts = []
for plane in planes:
    path_pts.append(plane.Origin)
path = rg.PolyCurve.CreateInterpolatedCurve(path_pts,1)






"""

points = []
lines = []

x_step = 30
y_step = 20
margin = 20

temp_x = r.randint(0, x_size)
temp_y = r.randint(0, y_size)

start_pt = rg.Point3d(temp_x, temp_y, 0)
points.append(start_pt)

for i in range(iterations):
    temp_x = r.randint(-x_step, x_step)
    temp_y = r.randint(-y_step, y_step)
    
    temp_vec = rg.Vector3d(temp_x, temp_y, 0)
    temp_pt = points[-1] + temp_vec
    
    
    if temp_pt.X < margin or temp_pt.X > x_size - margin:
        temp_pt = points[r.randint(0, len(points))]
    if temp_pt.Y < margin or temp_pt.Y > y_size - margin:
        temp_pt = points[r.randint(0, len(points))]
    
    
    if temp_pt.X < margin or temp_pt.X > x_size - margin:
        temp_pt = points[-1] + rg.Vector3d(-2 * temp_vec.X, 0, 0)
    if temp_pt.Y < margin or temp_pt.Y > y_size - margin:
        temp_pt = points[-1] + rg.Vector3d(0, -2 * temp_vec.Y, 0)
    
    points.append(temp_pt)

for i,pt in enumerate(points):
    if i < len(points) - 1:
        temp_line = rg.Line(pt, points[i+1])
        lines.append(temp_line)


interpolated_curve = rg.Curve.CreateInterpolatedCurve(points, 3)
control_pt_curve= rg.Curve.CreateControlPointCurve(points, 3)
"""
# ---------- end random_walk_3 ----------
new_random_walk = PythonScript(
    style=list_5,
    SEED=seed_5,
    x_size=Slider(600, range=0..1000),
    y_size=Slider(400, range=0..1000),
    iterations=Slider(558, range=0..10000))  # -> out, drawing_canvas, points, lines, planes; inputs SEED: Int32, x_size: Int32, y_size: Int32, iterations: Int32
# ---------- new_random_walk: Python ----------
import Rhino.Geometry as rg

import random as r
r.seed(SEED)

drawing_canvas = rg.Rectangle3d(rg.Plane.WorldXY, x_size, y_size)

points = []
lines = []
planes = []


for i in range(iterations):
    temp_x = r.randint(0, x_size)
    temp_y = r.randint(0, y_size)
    
    temp_pt = rg.Point3d( temp_x, temp_y, 0)
    points.append(temp_pt)

for i in range(len(points)-1):
    temp_line = rg.Line(points[i],points[i+1])
    lines.append(temp_line)

z_offset = rg.Vector3d(0,0,20)


if style == "points":
    temp_plane = rg.Plane(points[0]+z_offset, rg.Vector3d.ZAxis)
    planes.append(temp_plane)
    for pt in points:
        temp_plane = rg.Plane(pt, rg.Vector3d.ZAxis)
        planes.append(temp_plane)
        temp_plane = rg.Plane(pt+z_offset, rg.Vector3d.ZAxis)
        planes.append(temp_plane)
elif style == "lines":
    temp_plane = rg.Plane(points[0]+z_offset, rg.Vector3d.ZAxis)
    planes.append(temp_plane)
    for pt in points:
        temp_plane = rg.Plane(pt, rg.Vector3d.ZAxis)
        planes.append(temp_plane)
    temp_plane = rg.Plane(points[len(points)-1]+z_offset, rg.Vector3d.ZAxis)
    planes.append(temp_plane)
# ---------- end new_random_walk ----------
random_walk_4 = PythonScript(
    z_depth_value=z_depth_value,
    z_depth=toggle,
    type=list_3,
    selection=list_4,
    SEED=seed_3,
    x_size=number_slider_5,
    y_size=number_slider_6,
    iterations=iterations_3,
    z_offset=z_offset_2,
    margin=margin_2,
    crv_div=crv_div_2,
    x_step=x_step_2,
    y_step=y_step_2)  # -> out, paper_size, geom, planes, path; inputs x_size: Int32, y_size: Int32, iterations: Int32, z_offset: Int32, x_step: Int32, y_step: Int32; disabled
# ---------- random_walk_4: Python ----------
import Rhino.Geometry as rg
import rhinoscriptsyntax as rs

import random as r
r.seed(_SEED)

paper_size = rg.Rectangle3d(rg.Plane(rg.Point3d(0,0,0),rg.Vector3d.ZAxis),600,400)

points = []
lines = []

if _type == "simple_random_walk ":
    for i in range(iterations):
        temp_x = r.randint(margin, x_size - margin)
        temp_y = r.randint(margin, y_size - margin)
        
        if _z_depth:
            temp_z = r.uniform(0, _z_depth_value)
        else:
            temp_z = 0
        temp_pt = rg.Point3d(temp_x, temp_y, temp_z)
        points.append(temp_pt)

elif _type == "step_random_walk":
    temp_x = r.randint(0, x_size)
    temp_y = r.randint(0, y_size)
    
    start_pt = rg.Point3d(temp_x, temp_y, 0)
    points.append(start_pt)
    
    for i in range(iterations):
        temp_x = r.randint(-x_step, x_step)
        temp_y = r.randint(-y_step, y_step)
        
        if _z_depth:
            temp_z = r.uniform(0, _z_depth_value)
        else:
            temp_z = 0
        
        temp_vec = rg.Vector3d(temp_x, temp_y, 0)
        temp_pt = points[-1] + temp_vec
        temp_pt.Z = temp_z
        
        """
        if temp_pt.X < margin or temp_pt.X > x_size - margin:
            temp_pt = points[r.randint(0, len(points)-1)]
        if temp_pt.Y < margin or temp_pt.Y > y_size - margin:
            temp_pt = points[r.randint(0, len(points)-1)]
        """
        
        if temp_pt.X < margin or temp_pt.X > x_size - margin:
            temp_pt = points[-1] + rg.Vector3d(-2 * temp_vec.X, 0, 0)
        if temp_pt.Y < margin or temp_pt.Y > y_size - margin:
            temp_pt = points[-1] + rg.Vector3d(0, -2 * temp_vec.Y, 0)
        
        points.append(temp_pt)

for i,pt in enumerate(points):
    if i < len(points) - 1:
        temp_line = rg.Line(pt, points[i+1])
        lines.append(temp_line)

if _selection == "points":
    geom = points
    planes = []
    for pt in points:
        planes.append(rg.Plane(pt+rg.Vector3d(0,0,z_offset),rg.Vector3d.ZAxis))
        planes.append(rg.Plane(pt,rg.Vector3d.ZAxis))
    planes.append(rg.Plane(pt+rg.Vector3d(0,0,z_offset),rg.Vector3d.ZAxis))
elif _selection == "lines":
    geom = lines
    planes = []
    planes.append(rg.Plane(points[0]+rg.Vector3d(0,0,z_offset),rg.Vector3d.ZAxis))
    for pt in points:
        planes.append(rg.Plane(pt,rg.Vector3d.ZAxis))
    planes.append(rg.Plane(pt+rg.Vector3d(0,0,z_offset),rg.Vector3d.ZAxis))
elif _selection == "control_pt_curve":
    geom = rg.Curve.CreateControlPointCurve(points, 3)
    planes = []
    points = geom.DivideByCount(crv_div,True)
    points = [rs.EvaluateCurve(geom, t) for t in points]
    planes.append(rg.Plane(points[0]+rg.Vector3d(0,0,z_offset),rg.Vector3d.ZAxis))
    for pt in points:
        planes.append(rg.Plane(pt,rg.Vector3d.ZAxis))
    planes.append(rg.Plane(pt+rg.Vector3d(0,0,z_offset),rg.Vector3d.ZAxis))
elif _selection == "interpolated_curve":
    geom = rg.Curve.CreateInterpolatedCurve(points, 3)
    planes = []
    points = geom.DivideByCount(crv_div,True)
    points = [rs.EvaluateCurve(geom, t) for t in points]
    planes.append(rg.Plane(points[0]+rg.Vector3d(0,0,z_offset),rg.Vector3d.ZAxis))
    for pt in points:
        planes.append(rg.Plane(pt,rg.Vector3d.ZAxis))
    planes.append(rg.Plane(pt+rg.Vector3d(0,0,z_offset),rg.Vector3d.ZAxis))

path_pts = []
for plane in planes:
    path_pts.append(plane.Origin)
path = rg.PolyCurve.CreateInterpolatedCurve(path_pts,1)






"""

points = []
lines = []

x_step = 30
y_step = 20
margin = 20

temp_x = r.randint(0, x_size)
temp_y = r.randint(0, y_size)

start_pt = rg.Point3d(temp_x, temp_y, 0)
points.append(start_pt)

for i in range(iterations):
    temp_x = r.randint(-x_step, x_step)
    temp_y = r.randint(-y_step, y_step)
    
    temp_vec = rg.Vector3d(temp_x, temp_y, 0)
    temp_pt = points[-1] + temp_vec
    
    
    if temp_pt.X < margin or temp_pt.X > x_size - margin:
        temp_pt = points[r.randint(0, len(points))]
    if temp_pt.Y < margin or temp_pt.Y > y_size - margin:
        temp_pt = points[r.randint(0, len(points))]
    
    
    if temp_pt.X < margin or temp_pt.X > x_size - margin:
        temp_pt = points[-1] + rg.Vector3d(-2 * temp_vec.X, 0, 0)
    if temp_pt.Y < margin or temp_pt.Y > y_size - margin:
        temp_pt = points[-1] + rg.Vector3d(0, -2 * temp_vec.Y, 0)
    
    points.append(temp_pt)

for i,pt in enumerate(points):
    if i < len(points) - 1:
        temp_line = rg.Line(pt, points[i+1])
        lines.append(temp_line)


interpolated_curve = rg.Curve.CreateInterpolatedCurve(points, 3)
control_pt_curve= rg.Curve.CreateControlPointCurve(points, 3)
"""
# ---------- end random_walk_4 ----------
geom = Geometry(random_walk_3.geom)  # disabled
planes = Geometry(random_walk_3.planes)  # disabled
path = Geometry(random_walk_3.path)  # disabled
paper_size = Geometry(random_walk_3.paper_size)  # disabled
geo = Geometry(new_random_walk.planes)
geo_2 = Geometry(new_random_walk.drawing_canvas)
planes_2 = Geometry(random_walk_4.planes)  # disabled
path_2 = Geometry(random_walk_4.path)  # disabled
geom_2 = Geometry(random_walk_4.geom)  # disabled
paper_size_2 = Geometry(random_walk_4.paper_size)  # disabled
