# Grasshopper definition 160929_radom_walk_examples_KD.gh (Grasshopper 0.9.76)
# plug-ins: Python Interpreter

# ---- group: simple_random_walk
iterations = Slider(338, range=0..1000)
seed = Slider(32543989, range=0..100000000)
random_walk = PythonScript(SEED=seed, x_size=Slider(600, range=0..1000), y_size=Slider(400, range=0..1000), iterations=iterations)  # -> out, points, lines, interpolated_curve, control_pt_curve; inputs x_size: Int32, y_size: Int32, iterations: Int32
# ---------- random_walk: Python ----------
import Rhino.Geometry as rg

import random as r
r.seed(_SEED)

points = []
lines = []

for i in range(iterations):
    temp_x = r.randint(0, x_size)
    temp_y = r.randint(0, y_size)
    
    temp_pt = rg.Point3d(temp_x, temp_y, 0)
    points.append(temp_pt)

for i,pt in enumerate(points):
    if i < len(points) - 1:
        temp_line = rg.Line(pt, points[i+1])
        lines.append(temp_line)


interpolated_curve = rg.Curve.CreateInterpolatedCurve(points, 3)
control_pt_curve= rg.Curve.CreateControlPointCurve(points, 3)
# ---------- end random_walk ----------
points = Geometry(random_walk.points)
interpolated_curve = Geometry(random_walk.interpolated_curve)
control_pt_curve = Geometry(random_walk.control_pt_curve)
lines = Geometry(random_walk.lines)

# ----
iterations_2 = Slider(146, range=0..1000)
z_offset = Slider(20, range=0..100)
margin = Slider(20, range=0..100)
crv_div = Slider(100, range=0..100)
x_step = Slider(35, range=0..100)
y_step = Slider(36, range=0..100)
seed_2 = Slider(67799986, range=0..100000000)
list = ValueList({"simple_random_walk": "simple_random_walk ", "step_random_walk"}, selected="step_random_walk")
list_2 = ValueList({"points", "lines", "control_pt_curve", "interpolated_curve"}, selected="control_pt_curve")
random_walk_2 = PythonScript(
    type=list,
    selection=list_2,
    SEED=seed_2,
    x_size=Slider(600, range=0..1000),
    y_size=Slider(400, range=0..1000),
    iterations=iterations_2,
    z_offset=z_offset,
    margin=margin,
    crv_div=crv_div,
    x_step=x_step,
    y_step=y_step)  # -> out, paper_size, geom, planes, path; inputs x_size: Int32, y_size: Int32, iterations: Int32, z_offset: Int32, x_step: Int32, y_step: Int32
# ---------- random_walk_2: Python ----------
import Rhino.Geometry as rg
import rhinoscriptsyntax as rs

import random as r
r.seed(_SEED)

paper_size = rg.Rectangle3d(rg.Plane(rg.Point3d(0,0,0),rg.Vector3d.ZAxis),600,400)

points = []
lines = []

if _type == "simple_random_walk ":
    for i in range(iterations):
        temp_x = r.randint(margin, x_size - margin)
        temp_y = r.randint(margin, y_size - margin)
        
        temp_pt = rg.Point3d(temp_x, temp_y, 0)
        points.append(temp_pt)

elif _type == "step_random_walk":
    temp_x = r.randint(0, x_size)
    temp_y = r.randint(0, y_size)
    
    start_pt = rg.Point3d(temp_x, temp_y, 0)
    points.append(start_pt)
    
    for i in range(iterations):
        temp_x = r.randint(-x_step, x_step)
        temp_y = r.randint(-y_step, y_step)
        
        temp_vec = rg.Vector3d(temp_x, temp_y, 0)
        temp_pt = points[-1] + temp_vec
        
        """
        if temp_pt.X < margin or temp_pt.X > x_size - margin:
            temp_pt = points[r.randint(0, len(points)-1)]
        if temp_pt.Y < margin or temp_pt.Y > y_size - margin:
            temp_pt = points[r.randint(0, len(points)-1)]
        """
        
        if temp_pt.X < margin or temp_pt.X > x_size - margin:
            temp_pt = points[-1] + rg.Vector3d(-2 * temp_vec.X, 0, 0)
        if temp_pt.Y < margin or temp_pt.Y > y_size - margin:
            temp_pt = points[-1] + rg.Vector3d(0, -2 * temp_vec.Y, 0)
        
        points.append(temp_pt)

for i,pt in enumerate(points):
    if i < len(points) - 1:
        temp_line = rg.Line(pt, points[i+1])
        lines.append(temp_line)

if _selection == "points":
    geom = points
    planes = []
    for pt in points:
        planes.append(rg.Plane(pt+rg.Vector3d(0,0,z_offset),rg.Vector3d.ZAxis))
        planes.append(rg.Plane(pt,rg.Vector3d.ZAxis))
    planes.append(rg.Plane(pt+rg.Vector3d(0,0,z_offset),rg.Vector3d.ZAxis))
elif _selection == "lines":
    geom = lines
    planes = []
    planes.append(rg.Plane(points[0]+rg.Vector3d(0,0,z_offset),rg.Vector3d.ZAxis))
    for pt in points:
        planes.append(rg.Plane(pt,rg.Vector3d.ZAxis))
    planes.append(rg.Plane(pt+rg.Vector3d(0,0,z_offset),rg.Vector3d.ZAxis))
elif _selection == "control_pt_curve":
    geom = rg.Curve.CreateControlPointCurve(points, 3)
    planes = []
    points = geom.DivideByCount(crv_div,True)
    points = [rs.EvaluateCurve(geom, t) for t in points]
    planes.append(rg.Plane(points[0]+rg.Vector3d(0,0,z_offset),rg.Vector3d.ZAxis))
    for pt in points:
        planes.append(rg.Plane(pt,rg.Vector3d.ZAxis))
    planes.append(rg.Plane(pt+rg.Vector3d(0,0,z_offset),rg.Vector3d.ZAxis))
elif _selection == "interpolated_curve":
    geom = rg.Curve.CreateInterpolatedCurve(points, 3)
    planes = []
    points = geom.DivideByCount(crv_div,True)
    points = [rs.EvaluateCurve(geom, t) for t in points]
    planes.append(rg.Plane(points[0]+rg.Vector3d(0,0,z_offset),rg.Vector3d.ZAxis))
    for pt in points:
        planes.append(rg.Plane(pt,rg.Vector3d.ZAxis))
    planes.append(rg.Plane(pt+rg.Vector3d(0,0,z_offset),rg.Vector3d.ZAxis))

path_pts = []
for plane in planes:
    path_pts.append(plane.Origin)
path = rg.PolyCurve.CreateInterpolatedCurve(path_pts,1)






"""

points = []
lines = []

x_step = 30
y_step = 20
margin = 20

temp_x = r.randint(0, x_size)
temp_y = r.randint(0, y_size)

start_pt = rg.Point3d(temp_x, temp_y, 0)
points.append(start_pt)

for i in range(iterations):
    temp_x = r.randint(-x_step, x_step)
    temp_y = r.randint(-y_step, y_step)
    
    temp_vec = rg.Vector3d(temp_x, temp_y, 0)
    temp_pt = points[-1] + temp_vec
    
    
    if temp_pt.X < margin or temp_pt.X > x_size - margin:
        temp_pt = points[r.randint(0, len(points))]
    if temp_pt.Y < margin or temp_pt.Y > y_size - margin:
        temp_pt = points[r.randint(0, len(points))]
    
    
    if temp_pt.X < margin or temp_pt.X > x_size - margin:
        temp_pt = points[-1] + rg.Vector3d(-2 * temp_vec.X, 0, 0)
    if temp_pt.Y < margin or temp_pt.Y > y_size - margin:
        temp_pt = points[-1] + rg.Vector3d(0, -2 * temp_vec.Y, 0)
    
    points.append(temp_pt)

for i,pt in enumerate(points):
    if i < len(points) - 1:
        temp_line = rg.Line(pt, points[i+1])
        lines.append(temp_line)


interpolated_curve = rg.Curve.CreateInterpolatedCurve(points, 3)
control_pt_curve= rg.Curve.CreateControlPointCurve(points, 3)
"""
# ---------- end random_walk_2 ----------
path = Geometry(random_walk_2.path)
paper_size = Geometry(random_walk_2.paper_size)
planes = Geometry(random_walk_2.planes)
geom = Geometry(random_walk_2.geom)

z_depth_value = Slider(5, range=0..10)
iterations_3 = Slider(146, range=0..1000)
z_offset_2 = Slider(20, range=0..100)
margin_2 = Slider(20, range=0..100)
crv_div_2 = Slider(45, range=0..100)
x_step_2 = Slider(30, range=0..100)
y_step_2 = Slider(20, range=0..100)
seed_3 = Slider(67799986, range=0..100000000)
list_3 = ValueList({"simple_random_walk": "simple_random_walk ", "step_random_walk"}, selected="step_random_walk")
list_4 = ValueList({"points", "lines", "control_pt_curve", "interpolated_curve"}, selected="control_pt_curve")
random_walk_3 = PythonScript(
    z_depth_value=z_depth_value,
    z_depth=Toggle(True),
    type=list_3,
    selection=list_4,
    SEED=seed_3,
    x_size=Slider(600, range=0..1000),
    y_size=Slider(400, range=0..1000),
    iterations=iterations_3,
    z_offset=z_offset_2,
    margin=margin_2,
    crv_div=crv_div_2,
    x_step=x_step_2,
    y_step=y_step_2)  # -> out, paper_size, geom, planes, path; inputs x_size: Int32, y_size: Int32, iterations: Int32, z_offset: Int32, x_step: Int32, y_step: Int32
# ---------- random_walk_3: Python ----------
import Rhino.Geometry as rg
import rhinoscriptsyntax as rs

import random as r
r.seed(_SEED)

paper_size = rg.Rectangle3d(rg.Plane(rg.Point3d(0,0,0),rg.Vector3d.ZAxis),600,400)

points = []
lines = []

if _type == "simple_random_walk ":
    for i in range(iterations):
        temp_x = r.randint(margin, x_size - margin)
        temp_y = r.randint(margin, y_size - margin)
        
        if _z_depth:
            temp_z = r.uniform(0, _z_depth_value)
        else:
            temp_z = 0
        temp_pt = rg.Point3d(temp_x, temp_y, temp_z)
        points.append(temp_pt)

elif _type == "step_random_walk":
    temp_x = r.randint(0, x_size)
    temp_y = r.randint(0, y_size)
    
    start_pt = rg.Point3d(temp_x, temp_y, 0)
    points.append(start_pt)
    
    for i in range(iterations):
        temp_x = r.randint(-x_step, x_step)
        temp_y = r.randint(-y_step, y_step)
        
        if _z_depth:
            temp_z = r.uniform(0, _z_depth_value)
        else:
            temp_z = 0
        
        temp_vec = rg.Vector3d(temp_x, temp_y, 0)
        temp_pt = points[-1] + temp_vec
        temp_pt.Z = temp_z
        
        """
        if temp_pt.X < margin or temp_pt.X > x_size - margin:
            temp_pt = points[r.randint(0, len(points)-1)]
        if temp_pt.Y < margin or temp_pt.Y > y_size - margin:
            temp_pt = points[r.randint(0, len(points)-1)]
        """
        
        if temp_pt.X < margin or temp_pt.X > x_size - margin:
            temp_pt = points[-1] + rg.Vector3d(-2 * temp_vec.X, 0, 0)
        if temp_pt.Y < margin or temp_pt.Y > y_size - margin:
            temp_pt = points[-1] + rg.Vector3d(0, -2 * temp_vec.Y, 0)
        
        points.append(temp_pt)

for i,pt in enumerate(points):
    if i < len(points) - 1:
        temp_line = rg.Line(pt, points[i+1])
        lines.append(temp_line)

if _selection == "points":
    geom = points
    planes = []
    for pt in points:
        planes.append(rg.Plane(pt+rg.Vector3d(0,0,z_offset),rg.Vector3d.ZAxis))
        planes.append(rg.Plane(pt,rg.Vector3d.ZAxis))
    planes.append(rg.Plane(pt+rg.Vector3d(0,0,z_offset),rg.Vector3d.ZAxis))
elif _selection == "lines":
    geom = lines
    planes = []
    planes.append(rg.Plane(points[0]+rg.Vector3d(0,0,z_offset),rg.Vector3d.ZAxis))
    for pt in points:
        planes.append(rg.Plane(pt,rg.Vector3d.ZAxis))
    planes.append(rg.Plane(pt+rg.Vector3d(0,0,z_offset),rg.Vector3d.ZAxis))
elif _selection == "control_pt_curve":
    geom = rg.Curve.CreateControlPointCurve(points, 3)
    planes = []
    points = geom.DivideByCount(crv_div,True)
    points = [rs.EvaluateCurve(geom, t) for t in points]
    planes.append(rg.Plane(points[0]+rg.Vector3d(0,0,z_offset),rg.Vector3d.ZAxis))
    for pt in points:
        planes.append(rg.Plane(pt,rg.Vector3d.ZAxis))
    planes.append(rg.Plane(pt+rg.Vector3d(0,0,z_offset),rg.Vector3d.ZAxis))
elif _selection == "interpolated_curve":
    geom = rg.Curve.CreateInterpolatedCurve(points, 3)
    planes = []
    points = geom.DivideByCount(crv_div,True)
    points = [rs.EvaluateCurve(geom, t) for t in points]
    planes.append(rg.Plane(points[0]+rg.Vector3d(0,0,z_offset),rg.Vector3d.ZAxis))
    for pt in points:
        planes.append(rg.Plane(pt,rg.Vector3d.ZAxis))
    planes.append(rg.Plane(pt+rg.Vector3d(0,0,z_offset),rg.Vector3d.ZAxis))

path_pts = []
for plane in planes:
    path_pts.append(plane.Origin)
path = rg.PolyCurve.CreateInterpolatedCurve(path_pts,1)






"""

points = []
lines = []

x_step = 30
y_step = 20
margin = 20

temp_x = r.randint(0, x_size)
temp_y = r.randint(0, y_size)

start_pt = rg.Point3d(temp_x, temp_y, 0)
points.append(start_pt)

for i in range(iterations):
    temp_x = r.randint(-x_step, x_step)
    temp_y = r.randint(-y_step, y_step)
    
    temp_vec = rg.Vector3d(temp_x, temp_y, 0)
    temp_pt = points[-1] + temp_vec
    
    
    if temp_pt.X < margin or temp_pt.X > x_size - margin:
        temp_pt = points[r.randint(0, len(points))]
    if temp_pt.Y < margin or temp_pt.Y > y_size - margin:
        temp_pt = points[r.randint(0, len(points))]
    
    
    if temp_pt.X < margin or temp_pt.X > x_size - margin:
        temp_pt = points[-1] + rg.Vector3d(-2 * temp_vec.X, 0, 0)
    if temp_pt.Y < margin or temp_pt.Y > y_size - margin:
        temp_pt = points[-1] + rg.Vector3d(0, -2 * temp_vec.Y, 0)
    
    points.append(temp_pt)

for i,pt in enumerate(points):
    if i < len(points) - 1:
        temp_line = rg.Line(pt, points[i+1])
        lines.append(temp_line)


interpolated_curve = rg.Curve.CreateInterpolatedCurve(points, 3)
control_pt_curve= rg.Curve.CreateControlPointCurve(points, 3)
"""
# ---------- end random_walk_3 ----------
paper_size_2 = Geometry(random_walk_3.paper_size)
path_2 = Geometry(random_walk_3.path)
geom_2 = Geometry(random_walk_3.geom)
planes_2 = Geometry(random_walk_3.planes)

# ---- group: step_random_walk
iterations_4 = Slider(600, range=0..1000)
seed_4 = Slider(42506951.96, range=0..100000000)
step_random_walk = PythonScript(SEED=seed_4, x_size=Slider(600, range=0..1000), y_size=Slider(400, range=0..1000), iterations=iterations_4)  # -> out, points, lines, interpolated_curve, control_pt_curve; inputs x_size: Int32, y_size: Int32, iterations: Int32
# ---------- step_random_walk: Python ----------
import Rhino.Geometry as rg

import random as r
r.seed(_SEED)

points = []
lines = []

x_step = 30
y_step = 20
margin = 20

temp_x = r.randint(0, x_size)
temp_y = r.randint(0, y_size)

start_pt = rg.Point3d(temp_x, temp_y, 0)
points.append(start_pt)

for i in range(iterations):
    temp_x = r.randint(-x_step, x_step)
    temp_y = r.randint(-y_step, y_step)
    
    temp_vec = rg.Vector3d(temp_x, temp_y, 0)
    temp_pt = points[-1] + temp_vec
    
    """
    if temp_pt.X < margin or temp_pt.X > x_size - margin:
        temp_pt = points[r.randint(0, len(points))]
    if temp_pt.Y < margin or temp_pt.Y > y_size - margin:
        temp_pt = points[r.randint(0, len(points))]
    """
    
    if temp_pt.X < margin or temp_pt.X > x_size - margin:
        temp_pt = points[-1] + rg.Vector3d(-2 * temp_vec.X, 0, 0)
    if temp_pt.Y < margin or temp_pt.Y > y_size - margin:
        temp_pt = points[-1] + rg.Vector3d(0, -2 * temp_vec.Y, 0)
    
    points.append(temp_pt)

for i,pt in enumerate(points):
    if i < len(points) - 1:
        temp_line = rg.Line(pt, points[i+1])
        lines.append(temp_line)


interpolated_curve = rg.Curve.CreateInterpolatedCurve(points, 3)
control_pt_curve= rg.Curve.CreateControlPointCurve(points, 3)
# ---------- end step_random_walk ----------
control_pt_curve_2 = Geometry(step_random_walk.control_pt_curve)
points_2 = Geometry(step_random_walk.points)
interpolated_curve_2 = Geometry(step_random_walk.interpolated_curve)
lines_2 = Geometry(step_random_walk.lines)
