# Grasshopper definition draw_dendrites_from_pts.gh (Grasshopper 1.0.7)

# ----
# . . . . . . . . . . . . . . . . . . . . .
# .                                       .
# .    <<      ><      ><       >< <<     .
# .    < ><   ><<     ><<<    ><    ><<   .
# .    << >< > ><    ><  ><     ><        .
# .    <<  ><  ><   ><<<<<><      ><      .
# .    <<      >< ><<     ><< ><    ><<   .
# .    <<      ><><<       ><<  >< <<     .
# .                                       .
# .             DFAB 2016/17              .
# . . . . . . . . . . . . . . . . . . . . .
# 
# Created on 28.09.2016
# 
# @author: kathrind
# Unload here if
# mas_lib was updated
unload_mas_lib = Button()
py = PythonScript(unload=unload_mas_lib)
# ---------- py: Python ----------
from useful import reload_mas_lib

if unload:
    reload_mas_lib()
# ---------- end py ----------

create_init_nodes_from_pts = Button()
dendrites = PythonScript(init=Button())  # -> out, ds
# ---------- dendrites: Python ----------
#from algorithms.dendrite_system.dendrite_sys_from_pts import DendriteSystemPts
import algorithms
import ghpythonlib.components as ghcomp
import Rhino.Geometry as rg
import math



ds = DendriteSystemPts()
# ---------- end dendrites ----------
pts = Point([<point referenced from the Rhino model> x3])
mycelium = PythonScript(ds=dendrites.ds, pts=pts, create_init_nodes_from_pts=create_init_nodes_from_pts)  # -> ds; inputs pts: list of Point3d
# ---------- mycelium: Python ----------
if create_init_nodes_from_pts:
    [ds.create_node(pt) for pt in pts]
# ---------- end mycelium ----------
python = PythonScript(ds=mycelium, step=Button())  # -> out, nodes, sources
# ---------- python: Python ----------
import Rhino.Geometry as rg
import ghpythonlib.components as ghcomp


sources =  [source.position for source in ds.sources]
nodes = [node.position for node in ds.nodes] 


if step:
               
    new_nodes = ds.step()
# ---------- end python ----------
pt = Point(python.sources)
pt_2 = Point(python.nodes)
cloud = CloudDisplay(Points=python.nodes, Colours=RGB(255, 20, 147), Size=10, SpriteType=0)
