# Grasshopper definition ex7_draw_triangles_ghpython.ghx (Grasshopper 1.0.7)

number_of_circles = Slider(50, range=10..100)
python = GhPythonScript(redraw=Button(ExpressionNormal="True", ExpressionPressed="False"), num=number_of_circles)  # -> out, pts, crcls; inputs num: Int32
# ---------- python: Python ----------
from random import random
from compas.geometry import Pointcloud
from compas.geometry import Point, Circle, Plane
from compas.utilities import i_to_green
from compas.utilities import i_to_red

from compas_ghpython.artists import PointArtist, CircleArtist

if redraw==True:
    
    # create point cloud within x and y bounds
    cloud = Pointcloud.from_bounds(10, 5, 0, num)
    
    # draw points of the pointcloud and circles around them in Rhino/GH geometry
    pts = []
    crcls = []
    for point in cloud:
        n = random()
        
        rpt = PointArtist(point).draw()
        pts.append(rpt)
    
        radius = n
        plane = Plane([0, 0, 0], [0, 0, 1])
        circle = Circle(plane, radius)
        circle.center = point
    
        rcrcl = CircleArtist(circle).draw()
        crcls.append(rcrcl)
# ---------- end python ----------
pt = Point(python.pts)
circle = Circle(python.crcls)
brep = Brep(circle)
preview = CustomPreview(Geometry=[pt, circle], Material=ColourSwatch(SwatchColor=RGBA(255, 204, 204, 108)))
preview_2 = CustomPreview(Geometry=brep, Material=ColourSwatch(SwatchColor=RGBA(255, 112, 112, 108)))
