# Grasshopper definition random_walk_from_image.gh (Grasshopper 0.9.76)
# plug-ins: Python Interpreter

# ----
# . . . . . . . . . . . . . . . . . . . . .
# .                                       .
# .    <<      ><      ><       >< <<     .
# .    < ><   ><<     ><<<    ><    ><<   .
# .    << >< > ><    ><  ><     ><        .
# .    <<  ><  ><   ><<<<<><      ><      .
# .    <<      >< ><<     ><< ><    ><<   .
# .    <<      ><><<       ><<  >< <<     .
# .                                       .
# .             DFAB 2016/17              .
# . . . . . . . . . . . . . . . . . . . . .
# 
# Created on 03.10.2016
# 
# @author: kathrind
# Unload here if
# mas_lib was updated
unload_mas_lib = Button()
py = PythonScript(unload=unload_mas_lib)
# ---------- py: Python ----------
from mas_lib.useful import reload_mas_lib

if unload:
    reload_mas_lib()
# ---------- end py ----------

py_2 = PythonScript()  # -> mas_lib_path
# ---------- py_2: Python ----------
import sys, os
import Grasshopper as gh

ghComp = ghenv.Component
ghDoc = ghComp.OnPingDocument()

# the full path of the gh file
path = ghDoc.FilePath
# the directory of the gh file
path = os.path.dirname(path)

mas_lib_idx = path.find("mas_lib")
mas_lib_path = path[:(mas_lib_idx + len("mas_lib"))]
# ---------- end py_2 ----------
# Example 2
panel = Panel("algorithms\random_walk\food\clint.jpg")
step = Slider(5, range=0..100)
py_3 = PythonScript(mas_lib_path=py_2, relative_file=panel)  # -> file_fullpath
# ---------- py_3: Python ----------
import os

file = os.path.join(mas_lib_path, relative_file)

assert(os.path.isfile(file))

file_fullpath = file
# ---------- end py_3 ----------
image_scale = Slider(1, range=0.1..10)
black_val = Slider(5, range=0..300)
mycelium = PythonScript(image_file=py_3, init=Button(), image_scale=image_scale, step=step, black_value=black_val)  # -> rw, cmesh, sources; inputs step: Int32
# ---------- mycelium: Python ----------
"""
from mas_lib.useful import import_or_reload


import_or_reload("mas_lib")
import_or_reload("mas_lib.algorithms")
import_or_reload("mas_lib.algorithms.random_walk", "RandomWalkImg")
import_or_reload("mas_lib.algorithms.random_walk.random_walk_from_image", "RandomWalkImg")
"""

from mas_lib.algorithms.random_walk.random_walk_from_image import RandomWalkImg

import ghpythonlib.components as ghcomp
import Rhino.Geometry as rg

 
rw = RandomWalkImg(image_file, step, black_value, step*3, scale_factor = image_scale)


sources = rw.sources
cmesh = rw.cmesh
# ---------- end mycelium ----------
cloud = CloudDisplay(Points=mycelium.sources, Colours=ColourSwatch(SwatchColor=RGB(60, 38, 189)), Size=1, SpriteType=0)
input_mesh = Mesh(mycelium.cmesh)
step_2 = BooleanToggle(False)
timer = Timer(TimerInterval=5, Target=step_3)  # disabled
step_3 = PythonScript(rw=mycelium.rw, step=step_2)  # -> walk
# ---------- step_3: Python ----------
import Rhino.Geometry as rg

if step:
    rw.step()

walk = rw.walk
# ---------- end step_3 ----------
pline = PolyLine(Vertices=step_3, Closed=False)
