# Grasshopper definition random_walk_from_image_mult.gh (Grasshopper 0.9.76)
# plug-ins: Python Interpreter

# ----
# . . . . . . . . . . . . . . . . . . . . .
# .                                       .
# .    <<      ><      ><       >< <<     .
# .    < ><   ><<     ><<<    ><    ><<   .
# .    << >< > ><    ><  ><     ><        .
# .    <<  ><  ><   ><<<<<><      ><      .
# .    <<      >< ><<     ><< ><    ><<   .
# .    <<      ><><<       ><<  >< <<     .
# .                                       .
# .             DFAB 2016/17              .
# . . . . . . . . . . . . . . . . . . . . .
# 
# Created on 03.10.2016
# 
# @author: kathrind
# Unload here if
# mas_lib was updated
unload_mas_lib = Button()
py = PythonScript(unload=unload_mas_lib)
# ---------- py: Python ----------
from mas_lib.useful import reload_mas_lib

if unload:
    reload_mas_lib()
# ---------- end py ----------

py_2 = PythonScript()  # -> mas_lib_path
# ---------- py_2: Python ----------
import sys, os
import Grasshopper as gh

ghComp = ghenv.Component
ghDoc = ghComp.OnPingDocument()

# the full path of the gh file
path = ghDoc.FilePath
# the directory of the gh file
path = os.path.dirname(path)

mas_lib_idx = path.find("mas_lib")
mas_lib_path = path[:(mas_lib_idx + len("mas_lib"))]
# ---------- end py_2 ----------
step = Slider(5, range=0..100)
py_3 = PythonScript(mas_lib_path=py_2, relative_file="algorithms\random_walk\food\clint.jpg")  # -> file_fullpath
# ---------- py_3: Python ----------
import os

file = os.path.join(mas_lib_path, relative_file)

assert(os.path.isfile(file))

file_fullpath = file
# ---------- end py_3 ----------
image_scale = Slider(1, range=0.1..10)
black_val = Slider(5, range=0..300)
mycelium = PythonScript(image_file=py_3, init=Button(), image_scale=image_scale, step=step, black_value=black_val)  # -> rw, cmesh, sources; inputs step: Int32
# ---------- mycelium: Python ----------
"""
from mas_lib.useful import import_or_reload


import_or_reload("mas_lib")
import_or_reload("mas_lib.algorithms")
import_or_reload("mas_lib.algorithms.random_walk", "RandomWalkImg")
import_or_reload("mas_lib.algorithms.random_walk.random_walk_from_image", "RandomWalkImg")
"""

from mas_lib.algorithms.random_walk.random_walk_from_image_mult import RandomWalkImg

import ghpythonlib.components as ghcomp
import Rhino.Geometry as rg

 
rw = RandomWalkImg(image_file, step, black_value, step*3, num_init_walks = 20, scale_factor = image_scale)

sources = rw.sources
cmesh = rw.cmesh
# ---------- end mycelium ----------
input_mesh = Mesh(mycelium.cmesh)
cloud = CloudDisplay(Points=mycelium.sources, Colours=ColourSwatch(SwatchColor=RGB(60, 38, 189)), Size=1, SpriteType=0)
step_2 = BooleanToggle(False)
step_3 = BooleanToggle(False)
timer = Timer(TimerInterval=20, Target=step_4)  # disabled
step_4 = PythonScript(rw=mycelium.rw, step=step_2, show=step_3)  # -> walks, dead_walks
# ---------- step_4: Python ----------
import Rhino.Geometry as rg
import ghpythonlib.components as ghcomp

if step:
    rw.step()


if show:
    walks = []
    dead_walks = []
    
    for w in rw.walks:
        if len(w) > 5:
            #pl = ghcomp.PolyLine(w, False)
            pl = ghcomp.NurbsCurve(w, 3, False)[0]
            walks.append(pl)
    
    for w in rw.dead_walks:
        if len(w) > 5:
            #pl = ghcomp.PolyLine(w, False)
            pl = ghcomp.NurbsCurve(w, 3, False)[0]
            dead_walks.append(pl)
# ---------- end step_4 ----------
crv = Curve(step_4.walks)
crv_2 = Curve(step_4.dead_walks)
