# Grasshopper definition viz_5_compas_ghpython.ghx (Grasshopper 1.0.7)

python = GhPythonScript(
    redraw=Button(),
    iterations=Slider(120, range=1..300),
    length_decrement=Slider(100, range=100..200),
    angle_increment=Slider(1, range=0.1..2))  # -> out, pts, pls; inputs iterations: Int32
# ---------- python: Python ----------
import math as m

from random import random

from compas.geometry import Pointcloud
from compas.geometry import Point, Circle, Plane, Polyline
from compas.utilities import i_to_green
from compas.utilities import i_to_red

from compas_ghpython.artists import PointArtist, PolylineArtist
import compas_ghpython


# function
def draw_triangles(len, length_decrement, angle, angle_increment, iterations, pts, pls):
    
    pt1x = len*m.cos(angle)
    pt1y = len*m.sin(angle)
    
    ang = m.radians(120)

    pt2x = m.cos(ang)*pt1x-m.sin(ang)*pt1y
    pt2y = m.sin(ang)*pt1x+m.cos(ang)*pt1y
    
    pt3x = m.cos(ang)*pt2x-m.sin(ang)*pt2y
    pt3y = m.sin(ang)*pt2x+m.cos(ang)*pt2y
    
    p1 = Point(pt1x, pt1y, 0)
    p2 = Point(pt2x, pt2y, 0)
    p3 = Point(pt3x, pt3y, 0)
    
    pts.append(p1)
    pts.append(p2)
    pts.append(p3)
    
    pls.append(Polyline([p1, p2, p3, p1]))

    if iterations-1>0:
        len -= len*length_decrement
        angle += angle_increment
        iterations -= 1
        # recursive function call
        draw_triangles(len, length_decrement, angle, angle_increment, iterations, pts, pls)


# start params
start_length = 10
length_decrement = 1/length_decrement
angle = m.radians(60)
angle_increment = m.radians(angle_increment)

# function call
pts = []
pls = []
draw_triangles(start_length, length_decrement, angle, angle_increment, iterations, pts, pls)

# conversion from COMPAS to Rhino/GH geometry
pts = [PointArtist(point).draw() for point in pts]
pls = [PolylineArtist(pl).draw()[0] for pl in pls]
# ---------- end python ----------
pt = Point(python.pts)
crv = Curve(python.pls)
preview = CustomPreview(Geometry=pt, Material=ColourSwatch(SwatchColor=RGBA(255, 178, 178, 108)))
preview_2 = CustomPreview(Geometry=crv, Material=ColourSwatch(SwatchColor=RGBA(0, 0, 0, 108)))
