# Grasshopper definition unload_modules.gh (Grasshopper 0.9.76)
# plug-ins: Python Interpreter

unload = Button()
unload_2 = PythonScript(unload=unload)
# ---------- unload_2: Python ----------
import sys

if unload:
    modules_to_pop = []
    
    for mod in sys.modules:
        if mod[:len("my_mas_lib")] == "my_mas_lib":
            modules_to_pop.append(mod)
    
    for mod in modules_to_pop:
        if mod in sys.modules:
            sys.modules.pop(mod)
            print "%s unloaded" % mod
# ---------- end unload_2 ----------
