# Grasshopper definition ex12_build_robot_model.gh (Grasshopper 1.0.7)

# ----
# Robot Model
build = Button()
build_robot = GhPythonScript(build=build)  # -> robot
# ---------- build_robot: Python ----------
from scriptcontext import sticky as st

from compas_fab.ghpython import RobotArtist
from compas.datastructures import Mesh
from compas.geometry import Circle, Cylinder, Frame, Plane, Translation
from compas.robots import RobotModel, Joint
from compas_fab.robots import Robot

# create cylinder in yz plane
radius, length = 0.3, 5
cylinder = Cylinder(Circle(Plane([0, 0, 0], [1, 0, 0]), radius), length)
cylinder.transform(Translation.from_vector([length / 2.0, 0, 0]))

# store robot in component
guid = str(ghenv.Component.InstanceGuid)
robot_key = "robot_" + guid

if robot_key not in st:
    st[robot_key] = None

if build:
    # create robot model
    model = RobotModel("robot", links=[], joints=[])
    
    # link meshes (calling Mesh.from_shape effectively creates a copy of the shape)
    mesh1 = Mesh.from_shape(cylinder)
    mesh2 = Mesh.from_shape(cylinder)
    
    # add links
    link0 = model.add_link("world")
    link1 = model.add_link("link1", visual_mesh=mesh1, visual_color=(0.2, 0.5, 0.6))
    link2 = model.add_link("link2", visual_mesh=mesh2, visual_color=(0.5, 0.6, 0.2))
    ee_link = model.add_link("ee_link")
    
    # add joints between the links
    axis = (0, 0, 1)
    
    joint1_origin = Frame.worldZX()
    model.add_joint("joint1", Joint.CONTINUOUS, link0, link1, joint1_origin, axis)
    
    joint2_origin = Frame((length, 0, 0), (1, 0, 0), (0, 1, 0))
    model.add_joint("joint2", Joint.CONTINUOUS, link1, link2, joint2_origin, axis)
    
    ee_joint_origin = Frame((length, 0, 0), (1, 0, 0), (0, 1, 0))
    model.add_joint("ee_joint", Joint.FIXED, link2, ee_link, ee_joint_origin, axis)
    
    artist = RobotArtist(model)
    robot = Robot(model, artist, client=None)
    st[robot_key] = robot

robot = st[robot_key]
# ---------- end build_robot ----------
robot = Data(build_robot)

build_robot_2 = GhPythonScript()  # -> out, robot
# ---------- build_robot_2: Python ----------
from compas_fab.ghpython import RobotArtist
from compas.datastructures import Mesh
from compas.geometry import Circle, Cylinder, Frame, Plane, Translation
from compas.robots import RobotModel, Joint
from compas_fab.robots import Robot

radius, length = 0.3, 5
cylinder = Cylinder(Circle(Plane([0,0,0], [1,0,0]),radius),length)
cylinder.transform(Translation.from_vector([length / 2.0, 0, 0]))

mesh1 = Mesh.from_shape(cylinder)
mesh2 = Mesh.from_shape(cylinder)

model = RobotModel("robot", links=[], joints=[])

link0 = model.add_link("base")
link1 = model.add_link("link1", visual_mesh=mesh1, visual_color=(0.2,0.5,0.6))
link2 = model.add_link("link2", visual_mesh=mesh2, visual_color=(0.5,0.6,0.2))
ee_link = model.add_link("ee_link")

axis = (0, 0, 1)

joint1_origin = Frame.worldZX()
model.add_joint("joint1", Joint.CONTINUOUS, link0, link1, joint1_origin, axis)

joint2_origin = Frame((length, 0, 0), (1, 0, 0), (0, 1, 0))
model.add_joint("joint2", Joint.CONTINUOUS, link1, link2, joint2_origin, axis)

ee_joint_origin = Frame((length, 0, 0), (1, 0, 0), (0, 1, 0))
model.add_joint("ee_joint", Joint.FIXED, link2, ee_link, ee_joint_origin, axis)

artist = RobotArtist(model)
robot = Robot(model, artist, client=None)
# ---------- end build_robot_2 ----------

# ----
# Info
info = PythonScript(robot=robot)  # -> out, main_group_name
# ---------- info: Python ----------
if robot:
    robot.info()
# ---------- end info ----------
panel = Panel(info.out)

# ---- group: forward kinematics
# Configuration
a1 = Slider(-7, range=-360..360)
a2 = Slider(89, range=-360..360)
jp = GhPythonScript()  # -> joint_positions
# ---------- jp: Python ----------
import math

joint_positions = [0,-90]
joint_positions = [math.radians(a) for a in joint_positions]
print joint_positions
# ---------- end jp ----------
forward_kinematics = PythonScript(robot=robot, set_joint_positions=Button(), joint_positions=jp, a1=a1, a2=a2)  # -> full_configuration; inputs joint_positions: list
# ---------- forward_kinematics: Python ----------
import math
import Grasshopper
from compas.robots import Joint
from compas_fab.robots import Configuration

if set_joint_positions:

    j = 0
    for i in range(ghenv.Component.Params.Input.Count):
        nslider = ghenv.Component.Params.Input[i].Sources[0]
        if nslider.GetType() == Grasshopper.Kernel.Special.GH_NumberSlider:
            nslider.TrySetSliderValue(math.degrees(joint_positions[j]))
            j += 1

if robot:
    joint_positions = [a1, a2]
    joint_types = robot.get_configurable_joint_types()
    for i, joint_type in enumerate(joint_types):
        if joint_type == Joint.REVOLUTE or joint_type == Joint.CONTINUOUS:
            joint_positions[i] = math.radians(joint_positions[i])
    full_configuration = Configuration(joint_positions, joint_types)
    
print(full_configuration)
# ---------- end forward_kinematics ----------

# ----
# Visualisation
show_tool_frame = BooleanToggle(False)
show_frames = BooleanToggle(True)
show_visual = BooleanToggle(True)
visualize = PythonScript(
    robot=robot,
    configuration=forward_kinematics,
    show_visual=show_visual,
    show_tool_frame=show_tool_frame,
    show_frames=show_frames)  # -> out, robot, visual, frames, tool_frame
# ---------- visualize: Python ----------
from compas.geometry import Vector
from compas.geometry import Point
from compas.geometry import Transformation
from compas.geometry import Frame
from compas_ghpython.artists import MeshArtist
from compas_fab.robots import Configuration

print(configuration)

if robot and configuration:
    
    robot.update(configuration, visual=show_visual, collision=False)
    
    if show_visual:
        visual = robot.artist.draw_visual()
    
    frames = robot.transformed_frames(configuration)
    
    if show_tool_frame:
        tool_frame = robot.forward_kinematics(configuration)
        print("Tool", tool_frame)
    
    if not show_frames:
        frames = None
# ---------- end visualize ----------
geo = Geometry(visualize.visual)
draw = GhPythonScript(frames=visualize.frames, scale=Slider(1, range=0..1))  # -> P, V, C, W; inputs frames: list
# ---------- draw: Python ----------
from System.Drawing import Color
from compas_ghpython.utilities import draw_frame

red = Color.FromArgb(255, 0, 0)
green = Color.FromArgb(0, 255, 0)
blue = Color.FromArgb(0, 0, 255)

P = []
V = []
C = []

scale = float(scale)

for frame in frames:
    if not frame:
        continue
    plane = draw_frame(frame)
    P += [plane.Origin] * 3
    V.append(plane.XAxis * scale)
    V.append(plane.YAxis * scale)
    V.append(plane.ZAxis * scale)
    C += [red, green, blue]

W = 3
# ---------- end draw ----------
preview = CustomPreview(Geometry=geo, Shader=ColourSwatch(SwatchColor=RGB(105, 105, 105)))
vdisex = VectorDisplayEx(Point=draw.P, Vector=draw.V, Colour=draw.C, Width=draw.W)
