# Grasshopper definition ex6_mesh_in_grasshopper.ghx (Grasshopper 1.0.7)

mesh_viz = GhPythonScript()  # -> out, mesh, vertices, edges, faces, labels, keys_bfo, colors_bfo
# ---------- mesh_viz: Python ----------
import sys, os
import ghpythonlib.components as ghcomp
import compas
from compas.datastructures import Mesh
from compas_ghpython.artists import MeshArtist

from compas.topology import breadth_first_ordering
from compas.utilities import i_to_red

ghComp = ghenv.Component
ghDoc = ghComp.OnPingDocument()
import Rhino.Geometry as rg

# the full path of the gh file
path_gh_file = ghDoc.FilePath

# the directory of the gh file
HERE = os.path.dirname(path_gh_file)
DATA = os.path.join(HERE, 'data')
FILE = os.path.join(DATA, 'faces.obj')

# import the mesh
mesh = Mesh.from_obj(FILE)

# Mesh Artist for visualization
artist = MeshArtist(mesh)
vertices = artist.draw_vertices()
edges = artist.draw_edges()
faces = artist.draw_faces()
labels = {key: key for key in mesh.vertices()}

# breadth_first_ordering
keys_bfo = breadth_first_ordering(mesh.adjacency, 0)
print(keys_bfo)

# color range
n = mesh.number_of_vertices()
colors_bfo = {key: i_to_red(1 - index / n) for index, key in enumerate(keys_bfo)}
colors_bfo = [ghcomp.ColourRGB(255, c[0], c[1], c[2]) for c in colors_bfo.values()]
# ---------- end mesh_viz ----------
pt = Point(mesh_viz.vertices)
mesh = Mesh(mesh_viz.faces)
line = Line(mesh_viz.edges)
tag = TextTag(Location=mesh_viz.vertices, Text=mesh_viz.labels, Colour=ColourSwatch(SwatchColor=RGB(0, 0, 0)))
preview = CustomPreview(Geometry=pt, Material=mesh_viz.colors_bfo)
preview_2 = CustomPreview(Geometry=mesh, Material=ColourSwatch(SwatchColor=RGB(214, 214, 214)))
preview_3 = CustomPreview(Geometry=line, Material=ColourSwatch(SwatchColor=RGB(0, 0, 0)))

mesh_viz_2 = GhPythonScript(show=Toggle(True), mesh=mesh_viz.mesh, keys_bfo=mesh_viz.keys_bfo, index=Slider(12, range=0..35))  # -> out, current_vertex, current_vertex_neighbors; inputs keys_bfo: list of Int32, index: Int32
# ---------- mesh_viz_2: Python ----------
import ghpythonlib.components as ghcomp
import compas
import compas_ghpython
from compas.datastructures import Mesh
from compas_ghpython.artists import MeshArtist


if show:

    key = keys_bfo[index]
    print(key)
    
    current_vertex = {'pos': mesh.vertex_coordinates(key), 'radius': 0.5}
    current_vertex = compas_ghpython.draw_spheres([current_vertex])

    current_vertex_neighbors_keys = mesh.vertex_neighbors(key)
    print current_vertex_neighbors_keys
    
    current_vertex_neighbors = [{'pos': mesh.vertex_coordinates(key), 'radius': 0.4} for key in current_vertex_neighbors_keys]
    current_vertex_neighbors = compas_ghpython.draw_spheres(current_vertex_neighbors)
# ---------- end mesh_viz_2 ----------
brep = Brep(mesh_viz_2.current_vertex)
brep_2 = Brep(mesh_viz_2.current_vertex_neighbors)
preview_4 = CustomPreview(Geometry=brep, Material=ColourSwatch(SwatchColor=RGB(255, 48, 48)))
preview_5 = CustomPreview(Geometry=brep_2, Material=ColourSwatch(SwatchColor=RGB(255, 207, 207)))
