# Grasshopper definition ex7_network_in_grasshopper.ghx (Grasshopper 1.0.7)

# ---- group: Network from file
network_viz = GhPythonScript()  # -> out, nodes, edges
# ---------- network_viz: Python ----------
import sys, os
import ghpythonlib.components as ghcomp
import compas
from compas.datastructures import Network
from compas_ghpython.artists import NetworkArtist

import compas_ghpython

ghComp = ghenv.Component
ghDoc = ghComp.OnPingDocument()

# the full path of the gh file
path_gh_file = ghDoc.FilePath

# the directory of the gh file
HERE = os.path.dirname(path_gh_file)
DATA = os.path.join(HERE, 'data')
FILE = os.path.join(DATA, 'lines.obj')

# load network
network = Network.from_obj(FILE)

# draw network in Rhino
nodes, edges = NetworkArtist(network).draw()
# ---------- end network_viz ----------
line = Line(network_viz.edges)
pt = Point(network_viz.nodes)
preview = CustomPreview(Geometry=pt, Material=ColourSwatch(SwatchColor=RGB(0, 0, 0)))
preview_2 = CustomPreview(Geometry=line, Material=ColourSwatch(SwatchColor=RGB(255, 48, 48)))

# ---- group: Network from lines
line_2 = Line([Line((16.23840007, 5.480409529, 0), (19.53971621, 1.85027704, 0)), Line((19.53971621, 1.85027704, 0), (21.88088862, 5.440951567, 0)), Line((16.23840007, 5.480409529, 0), (21.88088862, 5.440951567, 0)), Line((16.23840007, 5.480409529, 0), (18.22445082, 8.926404863, 0)), Line((18.22445082, 8.926404863, 0), (21.88088862, 5.440951567, 0)), Line((18.22445082, 8.926404863, 0), (22.11763639, 9.439358367, 0))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])
network_viz_2 = GhPythonScript(lines=line_2, key=Slider(3, range=0..6))  # -> out, nodes, edges, current_node, current_node_neighbors, labels; inputs lines: list of Line, key: Int32
# ---------- network_viz_2: Python ----------
import sys, os
import ghpythonlib.components as ghcomp
import compas
from compas.datastructures import Network
from compas_ghpython.artists import NetworkArtist
from compas_rhino.geometry import RhinoLine

import compas_ghpython
import Rhino.Geometry as rg

ghComp = ghenv.Component
ghDoc = ghComp.OnPingDocument()

# the full path of the gh file
path_gh_file = ghDoc.FilePath

# the directory of the gh file
HERE = os.path.dirname(path_gh_file)
DATA = os.path.join(HERE, 'data')
FILE = os.path.join(DATA, 'lines.obj')

#create network from lines
compas_lines = [RhinoLine.from_geometry(line).to_compas() for line in lines]
network = Network.from_lines(compas_lines)

# draw network in Rhino
nodes, edges = NetworkArtist(network).draw()

# draw current selected node and its neighbors in Rhino
current_node = {'pos': network.node_coordinates(key), 'radius': 0.5}
current_node = compas_ghpython.draw_spheres([current_node])

current_node_neighbors_keys = network.neighbors(key)
current_node_neighbors = [{'pos': network.node_coordinates(key), 'radius': 0.4} for key in current_node_neighbors_keys]
current_node_neighbors = compas_ghpython.draw_spheres(current_node_neighbors)

labels = {key: key for key in network.nodes()}
print labels
# ---------- end network_viz_2 ----------
pt_2 = Point(network_viz_2.nodes)
line_3 = Line(network_viz_2.edges)
brep = Brep(network_viz_2.current_node)
brep_2 = Brep(network_viz_2.current_node_neighbors)
tag = TextTag(Location=pt_2, Text=network_viz_2.labels, Colour=ColourSwatch(SwatchColor=RGB(0, 0, 0)))
preview_3 = CustomPreview(Geometry=brep, Material=ColourSwatch(SwatchColor=RGB(255, 48, 48)))
preview_4 = CustomPreview(Geometry=pt_2, Material=ColourSwatch(SwatchColor=RGB(255, 0, 0)))
preview_5 = CustomPreview(Geometry=brep_2, Material=ColourSwatch(SwatchColor=RGB(255, 207, 207)))
preview_6 = CustomPreview(Geometry=line_3, Material=ColourSwatch(SwatchColor=RGB(255, 48, 48)))
