# Grasshopper definition ABB_GoFa_robot_control_playground.gh (Grasshopper 1.0.7)

# ----
# Robot model
connect = BooleanToggle(True)
ros = ROSConnect(connect=connect)  # -> ros_client, is_connected; inputs port: Int32, connect: Boolean
#   port ip: The ip address ROS. Defaults to 127.0.0.1.
#   port port: The port of ROS. Defaults to 9090.
#   port connect: If True, connects to ROS. If False, disconnects from ROS. Defaults to False.
#   port ros_client: The ROS client.
#   port is_connected: True if connection established.
# ---------- ros: Python ----------
"""
Connect or disconnect to ROS.

COMPAS FAB v0.27.0
"""
from ghpythonlib.componentbase import executingcomponent as component
from scriptcontext import sticky as st

from compas_fab.backends import RosClient
from compas_fab.ghpython.components import create_id


class ROSConnect(component):
    def RunScript(self, ip, port, connect):
        ros_client = None

        ip = ip or '127.0.0.1'
        port = port or 9090

        key = create_id(self, 'ros_client')
        ros_client = st.get(key, None)

        if ros_client:
            st[key].close()
        if connect:
            st[key] = RosClient(ip, port)
            st[key].run(5)

        ros_client = st.get(key, None)
        is_connected = ros_client.is_connected if ros_client else False
        return (ros_client, is_connected)
# ---------- end ros ----------
load_robot = BooleanToggle(True)
robot = ROSRobot(ros_client=ros.ros_client, load=load_robot)  # -> robot; inputs load: Boolean
#   port ros_client: The ROS client.
#   port load: If True, loads the robot from ROS. Defaults to False.
# ---------- robot: Python ----------
"""
Load robot directly from ROS.

COMPAS FAB v0.27.0
"""
from compas_ghpython.artists import RobotModelArtist
from ghpythonlib.componentbase import executingcomponent as component
from scriptcontext import sticky as st

from compas_fab.ghpython.components import create_id


class ROSRobot(component):
    def RunScript(self, ros_client, load):
        key = create_id(self, 'robot')

        if ros_client and ros_client.is_connected and load:
            # Load URDF from ROS
            st[key] = ros_client.load_robot(load_geometry=True, precision='12f')
            st[key].artist = RobotModelArtist(st[key].model)

        robot = st.get(key, None)
        if robot:  # client sometimes need to be restarted, without needing to reload geometry
            robot.client = ros_client
        return robot
# ---------- end robot ----------

# ----
# Table
swatch = ColourSwatch(SwatchColor=RGB(255, 254, 254))
material = CreateMaterial(Diffuse=swatch, Specular=RGB(255, 254, 254), Emission=RGB(0, 0, 0), Transparency=0, Shine=0)
brep = Brep(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)
preview = CustomPreview(Geometry=brep, Material=material)

info = Info()  # -> info
#   port info: Environment info.
# ---------- info: Python ----------
"""
Displays information about the active COMPAS environment.
"""
import compas_bootstrapper
from ghpythonlib.componentbase import executingcomponent as component

import compas_fab


class CompasInfo(component):
    def RunScript(self):
        self.Message = "COMPAS FAB v{}".format(compas_fab.__version__)
        info = "COMPAS FAB Version: {}\nEnvironment: {}"
        return info.format(compas_fab.__version__, compas_bootstrapper.ENVIRONMENT_NAME)
# ---------- end info ----------
info_2 = Info()  # -> info
#   port info: Environment info.
# ---------- info_2: Python ----------
"""
Displays information about the active COMPAS environment.
"""
import compas_bootstrapper
from ghpythonlib.componentbase import executingcomponent as component

import compas


class CompasInfo(component):
    def RunScript(self):
        self.Message = "COMPAS v{}".format(compas.__version__)
        info = "COMPAS Version: {}\nEnvironment: {}"
        return info.format(compas.__version__, compas_bootstrapper.ENVIRONMENT_NAME)
# ---------- end info_2 ----------

# ----
# Element
# Predefine a brick element and its dimensions
# Visualise the defined element
show = BooleanToggle(False)
elem_def = GhPythonScript()  # -> out, elem_full
# ---------- elem_def: Python ----------
import os
import sys
import json

from compas.geometry import Frame

from assembly_information_model.assembly import Element

# dimensions full brick
width = 0.05
length = 0.1
height = 0.0265

elem_full = Element.from_dimensions(length, width, height)
elem_full.tool_frame = Frame([0, 0, height*2/3],  [1, 0, 0], [0, -1, 0])
# ---------- end elem_def ----------
draw = PythonScript(elem_full=elem_def.elem_full, show=show)  # -> M, F, S
# ---------- draw: Python ----------
from compas.geometry import Transformation
from compas.geometry import Frame
from compas.datastructures import mesh_transformed
from compas_ghpython.artists import MeshArtist
from compas_ghpython import draw_frame

if show:
    artist = MeshArtist(elem_full.mesh)
    M = [artist.draw()]
    F = [draw_frame(elem_full.frame)]
    #S = [draw_frame(elem_full._source.frame)]
    S = [draw_frame(elem_full.tool_frame)]
    
    
    artist = MeshArtist(elem_half.mesh)
    M += [artist.draw()]
    F += [draw_frame(elem_half.frame)]
    #S += [draw_frame(elem_half._source.frame)]
    S = [draw_frame(elem_half.tool_frame)]
# ---------- end draw ----------

# ----
# Tool
gripper_meshes = Mesh([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])
gripper_bounding_box_mesh = Mesh(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)
gripper_tcf = Plane(Plane(origin=(0, 0, 0.1534), x=(-0.7071067812, 0.7071067812, 0), y=(-0.7071067812, -0.7071067812, 0)))
mjoin = MeshJoin(Meshes=gripper_meshes)
tool = AttachedTool(robot=robot, visual_mesh=mjoin, collision_mesh=gripper_bounding_box_mesh, tcf_plane=gripper_tcf)  # -> robot; inputs visual_mesh: Mesh, collision_mesh: Mesh
#   port visual_mesh: A visual mesh for the tool.
#   port collision_mesh: A collision mesh for the tool.
#   port tcf_plane: The frame of the tool in tool0 frame.
#   port group: The planning group to which the tool should be attached.
# ---------- tool: Python ----------
"""
Attach a tool to the robot.

COMPAS FAB v0.27.0
"""
from ghpythonlib.componentbase import executingcomponent as component
from compas_rhino.conversions import RhinoMesh
from compas_rhino.conversions import plane_to_compas_frame

from compas.geometry import Frame
from compas_fab.robots import Tool


class AttachToolComponent(component):
    def RunScript(self, robot, visual_mesh, collision_mesh, tcf_plane, group):
        if robot and robot.client and robot.client.is_connected and visual_mesh:
            if not collision_mesh:
                collision_mesh = visual_mesh

            c_visual_mesh = RhinoMesh.from_geometry(visual_mesh).to_compas()
            c_collision_mesh = RhinoMesh.from_geometry(collision_mesh).to_compas()

            if not tcf_plane:
                frame = Frame.worldXY()
            else:
                frame = plane_to_compas_frame(tcf_plane)
            tool = Tool(c_visual_mesh, frame, c_collision_mesh)

            robot.attach_tool(tool, group)

        return robot
# ---------- end tool ----------

panel = Panel(info_2)
panel_2 = Panel(info)
panel_3 = Panel(ros.is_connected)

# ---- group: forward kinematics
# Forward Kinematics
load_presets = Button()
jp = GhPythonScript()  # -> all_joint_value_zero
# ---------- jp: Python ----------
import math
all_joint_value_zero = [0] * 6
print all_joint_value_zero
# ---------- end jp ----------
a1 = Slider(-22, range=-180..180)
a2 = Slider(0, range=-360..360)
a3 = Slider(0, range=-360..360)
a5 = Slider(0, range=-360..360)
a6 = Slider(0, range=-360..360)
a4 = Slider(0, range=-360..360)
forward_kinematics = PythonScript(robot=tool, set_joint_positions=load_presets, joint_positions=jp, a1=a1, a2=a2, a3=a3, a4=a4, a5=a5, a6=a6)  # -> full_configuration; inputs joint_positions: list
# ---------- forward_kinematics: Python ----------
import math
import Grasshopper
from compas.robots import Joint
from compas_fab.robots import Configuration

if set_joint_positions:

    j = 0
    for i in range(ghenv.Component.Params.Input.Count):
        nslider = ghenv.Component.Params.Input[i].Sources[0]
        if nslider.GetType() == Grasshopper.Kernel.Special.GH_NumberSlider:
            nslider.TrySetSliderValue(joint_positions[j])
            j += 1

if robot:
    joint_positions = [a1, a2, a3, a4, a5, a6]
    joint_types = robot.get_configurable_joint_types()
    for i, joint_type in enumerate(joint_types):
        if joint_type == Joint.REVOLUTE:
            joint_positions[i] = math.radians(joint_positions[i])
    full_configuration = Configuration(joint_positions, joint_types)
# ---------- end forward_kinematics ----------

# ----
jp_2 = GhPythonScript()  # -> packing_joint_values
# ---------- jp_2: Python ----------
import math
packing_joint_values = [0, 0, 85, 0, 0, 0]
print packing_joint_values
# ---------- end jp_2 ----------
jp_3 = GhPythonScript()  # -> home_vertical_joint_values
# ---------- jp_3: Python ----------
import math
home_vertical_joint_values = [0, 0, 0, 0, 90, -45]
print home_vertical_joint_values
# ---------- end jp_3 ----------

# ---- group: Simulation from MoveIt / target point
point = Point(Point(0.7088211533, 0.2451926781, 0.3866603496))

# ----
list = ValueList({"20", "50", "100", "500", "1000", "5000"}, selected="50")
back = Button()
reset = Button()
start = Button()
stop = Button()
step = Button()
full = Button()

show_end_effector_frame = BooleanToggle(True)
show_base_frame = BooleanToggle(False)
show_frames = BooleanToggle(True)

# ----
# Robot
# control
ros_client = Data(ros.ros_client)
number_slider = Slider(300, range=0..300)

# ---- group: PICK PLANE
pln = Plane(Plane(origin=(0.008659569547, 478.9905396, 168.5522919), x=(0.7071163696, -0.7070971821, 0.0001221992158), y=(-0.7070971926, -0.7071163622, 0.000102915822)))

# ---- group: HOME VERTICAL PLANE
pln_2 = Plane(Plane(origin=(550.0007324, -0.0004259967827, 717.9949341), x=(-0.7071095686, -0.7071039938, 2.741176192e-06), y=(-0.7071039938, 0.7071095686, 2.714447101e-06)))

# ----
prot = RotatePlane(Plane=pln, Angle=degrees("90"))

# ----
# Send text to flexpendant
button = Button()
python = GhPythonScript(message="Hello LE.AR.N!", ros=ros_client, run=button)
# ---------- python: Python ----------
import compas_rrc as rrc
abb = rrc.AbbClient(ros, '/rob1')
print('Connected.')

if run : 
    abb.send_and_wait(rrc.PrintText(message), timeout = 10)
# ---------- end python ----------

# ----
# Gripper on/off
open = Button()
close = Button()
python_2 = GhPythonScript(ros=ros_client, open=open, close=close)  # inputs open: Boolean
# ---------- python_2: Python ----------
import compas_rrc as rrc
abb = rrc.AbbClient(ros, '/rob1')
print('Connected.')

if open : 
    abb.send(rrc.SetDigital('ABB_Scalable_IO_0_DO16', 1))
    
if close : 
    abb.send(rrc.SetDigital('ABB_Scalable_IO_0_DO16', 0))
# ---------- end python_2 ----------

# ----
# Get frame and joint values
button_2 = Button()
python_3 = GhPythonScript(ros=ros_client, run=button_2)  # -> frame, joints
# ---------- python_3: Python ----------
import compas_rrc as rrc
abb = rrc.AbbClient(ros, '/rob1')
print('Connected.')

if run : 

    # Set tool
    abb.send(rrc.SetTool('tool0'))
    
    # Set work object
    abb.send(rrc.SetWorkObject('wobj0'))
    
    # Read current frame position
    frame = abb.send_and_wait(rrc.GetFrame(), timeout = 10)
    print("frame: ", frame)
    
    # Read current Configuration
    joints = abb.send_and_wait(rrc.GetJoints(), timeout = 10)
    print("joints: ", joints)
# ---------- end python_3 ----------
cluster = Cluster(rec=python_3.frame, rec_2=python_3.joints)  # -> plane, configuration_2
panel_4 = Panel(cluster.configuration_2)
panel_5 = Panel(cluster.plane)

list_2 = ValueList({"Send all elements": "all", "Send current element": "current"}, selected="Send current element")
table_mesh = Mesh(brep)

# ----
# Inputs
tolerance_deg = Slider(1, range=0..10)

approach_vector = GhPythonScript()  # -> out, vector
# ---------- approach_vector: Python ----------
from compas.geometry import Vector
vector = Vector(0, 0, .05)
# ---------- end approach_vector ----------
panel_6 = Panel("45")

# ----
# Assembly
y_axis = Curve(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)
x_axis = Curve(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)
plane = PythonScript(plane_axes=[x_axis, y_axis])  # -> plane; inputs plane_axes: list of Curve
# ---------- plane: Python ----------
import Rhino.Geometry as rg

x_axis, y_axis = plane_axes

x_axis = rg.Line(x_axis.PointAtStart, x_axis.PointAtEnd)
y_axis = rg.Line(y_axis.PointAtStart, y_axis.PointAtEnd)

if x_axis.From.DistanceTo(y_axis.From) < 0.01:
    origin = x_axis.From
    xvec = x_axis.Direction
    yvec = y_axis.Direction
elif x_axis.To.DistanceTo(y_axis.To) < 0.01:
    origin = x_axis.To
    xvec = -x_axis.Direction
    yvec = -y_axis.Direction
elif x_axis.From.DistanceTo(y_axis.To) < 0.01:
    origin = x_axis.From
    xvec = x_axis.Direction
    yvec = -y_axis.Direction
elif x_axis.To.DistanceTo(y_axis.From) < 0.01:
    origin = x_axis.To
    xvec = -x_axis.Direction
    yvec = y_axis.Direction

plane = rg.Plane(origin, xvec, yvec)
# ---------- end plane ----------
cp_new = Plane(plane)

# ----
# Brick wall
pt = Point([Point(0.9671119473, -0.03267675168, 0.0504260254), Point(-0.1029288014, 0.3971637288, -0.1479900893), Point(-0.5443898693, 0.6772395517, 0.8000593736)])

generate_assembly = GhPythonScript(elem_full=elem_def.elem_full, transform=Toggle(True), ptransf=cp_new, attr_pts=pt)  # -> assembly, COURSES; inputs ptransf: Plane, attr_pts: list of Point3d
# ---------- generate_assembly: Python ----------
import Rhino.Geometry as rg
import math
from scriptcontext import sticky as st


from compas.geometry import Frame
from compas.geometry import Transformation
from compas.geometry import Rotation
from compas.geometry import Translation
from compas.geometry import Point

from compas_ghpython import draw_frame

from assembly_information_model.assembly import Assembly

import Rhino.Geometry as rg



length, width, height = [elem_full._source.xsize, elem_full._source.ysize, elem_full._source.zsize]
#print(width, length, height)

COURSES = 7
bricks_in_course = 4

MORTAR_PERPENDS = 0.01

total_length = bricks_in_course * length + (bricks_in_course - 1) * MORTAR_PERPENDS
gap = MORTAR_PERPENDS

assembly = Assembly() # initialize an empty assembly class
planes = [] # just for vizualisation

for course in range(COURSES):
    dy = course * height
    is_odd = course % 2 != 0
    dx = 0
    for j in range(bricks_in_course):
        first = j == 0
        last = j == bricks_in_course - 1
        if is_odd:
            T = Translation.from_vector([dx + length/5 , 0, dy])
            e = elem_full.transformed(T)
            dx += length + gap/2
        else:
            T = Translation.from_vector([dx, 0, dy])
            e = elem_full.transformed(T)
            dx += length
        
        cpt = e.frame.point
        
        #apply rotation to the bricks according to the distance of the attractor points
        min_dist = 10
        for attr_pt in attr_pts:
            dist =  attr_pt.DistanceTo(rg.Point3d(cpt.x, cpt.y, cpt.z))
            if dist<min_dist:
                min_dist = dist
            #print dist
        dist = min_dist
        if is_odd:
            R = Rotation.from_axis_and_angle([0,0,1], -math.radians(1/(0.3*dist*dist)), point=e.frame.point) 
        else:
            R = Rotation.from_axis_and_angle([0,0,1], math.radians(1/(0.3*dist*dist)), point=e.frame.point) 
        e.transform(R)
        
        planes.append(draw_frame(e.tool_frame)) #only for visualizing in gh
        assembly.add_element(e, course=course)
        dx += gap

if transform:
    T = Transformation.from_frame_to_frame(Frame.worldXY(), Frame(ptransf.Origin, ptransf.XAxis, ptransf.YAxis))
    assembly.transform(T)
    assembly.network.transform(T)
# ---------- end generate_assembly ----------

add_edges = PythonScript(COURSES=generate_assembly.COURSES, assembly=generate_assembly.assembly)  # -> assembly; inputs COURSES: Int32
# ---------- add_edges: Python ----------
 
for course in range(COURSES):
    curr_course = [key for key in assembly.network.nodes_where({'course': course})]
    prev_course = [key for key in assembly.network.nodes_where({'course': course-1})]

    for k in range(len(curr_course)):
        if course != 0:
            assembly.add_connection(curr_course[k],prev_course[k])
            if k != len(curr_course)-1:
                assembly.add_connection(curr_course[k],prev_course[k+1])
# ---------- end add_edges ----------

# ----
# Draw assembly
show_2 = BooleanToggle(True)
show_3 = BooleanToggle(True)
show_4 = BooleanToggle(False)
show_5 = BooleanToggle(False)
show_6 = BooleanToggle(True)
panel_7 = Panel("Assembly Visualization")
counter = CountThroughList(
    assembly=generate_assembly.assembly,
    start=start,
    stop=stop,
    step=step,
    step_back=back,
    reset=reset,
    full=full,
    interval=list)  # -> item, counter; inputs start: Boolean, stop: Boolean, step_back: Boolean
# ---------- counter: Python ----------
from scriptcontext import sticky as st
from compas_ghpython import update_component


L = list(assembly.elements())
# store data in component
guid = str(ghenv.Component.InstanceGuid)
counter_key = "counter_" + guid
running_key = "running_" + guid

if counter_key not in st:
    st[counter_key] = 0

if running_key not in st:
    st[running_key] = False
    

if st[running_key]:
    if st[counter_key] < len(L) - 1:
        st[counter_key] += 1
        update_component(ghenv, interval)
    else:
        st[counter_key] = 0
        st[running_key] = False
    
    
if start:
    st[running_key] = True

if stop:
    st[running_key] = False

if step:
    if st[counter_key] < len(L) - 1:
        st[counter_key] += 1

if step_back:
    if st[counter_key] < len(L):
        st[counter_key] -= 1

if reset:
    st[counter_key] = 0

if full:
    st[counter_key] = len(L)-1

if len(L):
    item = L[st[counter_key]]



#st["visualisation_counter"] = st[counter_key]
#st[counter_key]= 50
counter = st[counter_key]
# ---------- end counter ----------
idx = Panel(counter.counter)
draw_2 = PythonScript(
    assembly=add_edges,
    current_key=idx,
    show_current_element=show_3,
    show_course=show_4,
    show_all=show_5,
    show_until_key=show_6,
    show_network=show_2)  # -> G_element, G_elements, G_course, current_tool_plane, current_path_planes, tool_planes_WCS, G_nodes, G_edges; inputs current_key: Int32
# ---------- draw_2: Python ----------
import os
import sys

import math

import Rhino.Geometry as rg

from compas_ghpython.artists import MeshArtist
from compas_ghpython.artists import NetworkArtist
from compas_ghpython import draw_frame


G_element = []
G_elements = []
G_course = []
G_nodes = []
G_edges = []

key_index = assembly.network.key_index()
keys = [key_index[key] for key in assembly.network.nodes()]

if show_current_element:
    element = assembly.element(current_key)
    artist = MeshArtist(element.mesh)
    mesh = artist.draw()
    G_element.append(mesh)

if show_course:
    course = assembly.network.node_attribute(key=current_key, name='course')
    keys_in_course = list(assembly.network.nodes_where({'course': course}))
    elements = [assembly.element(key) for key in keys_in_course]
    for element in elements:
        artist = MeshArtist(element.mesh)
        mesh = artist.draw()
        G_course.append(mesh)

if show_all and not show_until_key:
    elements = [assembly.element(key) for key in keys]
    for element in elements:
        artist = MeshArtist(element.mesh)
        mesh = artist.draw()
        G_elements.append(mesh)

if show_until_key:
    elements = [assembly.element(key) for key in keys]
    for element in elements[0:current_key+1]:
        artist = MeshArtist(element.mesh)
        mesh = artist.draw()
        G_elements.append(mesh)
        
if show_network:
    G_nodes, G_edges = NetworkArtist(assembly.network).draw()

tool_planes_WCS = [draw_frame(e.tool_frame) for e in elements]
current_tool_plane = tool_planes_WCS[current_key]
current_path_planes = [draw_frame(plane) for plane in assembly.element(current_key).path]
# ---------- end draw_2 ----------
pln_3 = Plane(draw_2.current_path_planes)
pln_4 = Plane(draw_2.current_tool_plane)
line = Line(draw_2.G_edges)
pt_2 = Point(draw_2.G_nodes)
geo = Geometry(draw_2.G_element)
geo_2 = Geometry(draw_2.G_elements)
geo_3 = Geometry(draw_2.G_course)
# Surface lowest point
colour_swatch = ColourSwatch(SwatchColor=RGB(255, 122, 122))
preview_2 = CustomPreview(Geometry=line, Shader=colour_swatch)
preview_3 = CustomPreview(Geometry=geo, Shader=ColourSwatch(SwatchColor=RGB(255, 143, 143)))
preview_4 = CustomPreview(Geometry=geo_3, Shader=ColourSwatch(SwatchColor=RGB(255, 204, 0)))
preview_5 = CustomPreview(Geometry=pt_2, Shader=ColourSwatch(SwatchColor=RGB(0, 0, 0)))

# ---- group: Simulation from MoveIt
# Inverse Kinematics
xy_plane = XYPlane(Origin=point)
zero_config = ZeroConfig(robot=tool)  # -> config
#   port group: If assigned, it will return the zero configuration for the given group, otherwise a full zero configuration.
#   port config: The zero configuration.
# ---------- zero_config: Python ----------
"""
Get a zero configuration for a robot.

COMPAS FAB v0.27.0
"""
from ghpythonlib.componentbase import executingcomponent as component


class ConfigZero(component):
    def RunScript(self, robot, group):

        if robot:
            return robot.zero_configuration(group)

        return None
# ---------- end zero_config ----------
flip_plane = FlipPlane(Plane=xy_plane, ReverseX=True, ReverseY=False, SwapAxes=False)
ik = InverseKinematics(robot=tool, plane=pln_4, start_configuration=zero_config)  # -> configuration
#   port plane: The plane or frame to calculate the inverse kinematic for.
#   port start_configuration: If passed, calculates the inverse such that the joint positions differ the least from the start_configuration. Defaults to the zero configuration.
#   port group: The planning group used for calculation. Defaults to the robot's main planning group.
#   port configuration: The planning group's configuration.
# ---------- ik: Python ----------
"""
Calculate the robot's inverse kinematic for a given plane.

COMPAS FAB v0.27.0
"""
from compas_rhino.conversions import RhinoPlane
from compas.geometry import Frame
from ghpythonlib.componentbase import executingcomponent as component


class InverseKinematics(component):
    def RunScript(self, robot, plane, start_configuration, group):
        configuration = None
        if robot and robot.client and robot.client.is_connected and plane:
            frame = RhinoPlane.from_geometry(plane).to_compas_frame()
            configuration = robot.inverse_kinematics(frame, start_configuration, group, options={
                                                    'avoid_collisions':False,
                                                    'return_full_configuration':True,
                                                  })     
        return configuration
# ---------- end ik ----------

# ----
preview_6 = CustomPreview(Geometry=geo_2, Shader=ColourSwatch(SwatchColor=RGB(255, 255, 255)))

# ----
# Draw robot
list_3 = ValueList({"Forward Kinematics": 0, "Inverse Kinematics": 1}, selected="Forward Kinematics")
entwine = Entwine(Branch00=forward_kinematics, Branch01=ik, FlattenInputs=True)  # -> simplify(Result)
path = ConstructPath(Indices=list_3)
branch = TreeBranch(Tree=entwine, Path=path, MaintainPaths=True)
robot_visualize = RobotVisualize(
    robot=tool,
    configuration=branch,
    show_frames=show_frames,
    show_base_frame=show_base_frame,
    show_end_effector_frame=show_end_effector_frame)  # -> visual, collision, collision_meshes, attached_meshes, frames, base_frame, ee_frame; inputs show_visual: Boolean, show_collision: Boolean, show_frames: Boolean, show_base_frame: Boolean, show_end_effector_frame: Boolean, show_cm: Boolean, show_acm: Boolean
#   port group: The planning group used for end-effector and base visualization.
#   port configuration: The robot's full configuration.
#   port show_visual: Whether or not to show the robot's visual meshes.
#   port show_collision: Whether or not to show the robot's collision meshes.
#   port show_frames: Whether or not to show the robot's joint frames.
#   port show_base_frame: Whether or not to show the robot's base frame.
#   port show_end_effector_frame: Whether or not to show the robot's end-effector frame.
#   port show_cm: Whether or not to show the collision meshes (if any).
#   port show_acm: Whether or not to show the attached collision meshes (if any).
#   port visual: Rhino meshes of the robot's visual geometry (if any).
#   port collision: Rhino meshes of the robot's collision geometry (if any).
#   port collision_meshes: Rhino meshes of the scene's collision meshes (if any).
#   port attached_meshes: Rhino meshes of the scene's attached collision meshes (if any).
#   port frames: The robot's joint frames as Rhino planes (if any).
#   port base_frame: The robot's base frame as a Rhino plane (if any).
#   port ee_frame: The robot's end-effector frame as a Rhino plane (if any).
# ---------- robot_visualize: Python ----------
"""
Visualizes the robot.

COMPAS FAB v0.27.0
"""
from compas.artists import Artist
from compas.geometry import Frame
from compas.geometry import Transformation
from compas_fab.robots import PlanningScene
from ghpythonlib.componentbase import executingcomponent as component


class RobotVisualize(component):
    def RunScript(
        self,
        robot,
        group,
        configuration,
        show_visual,
        show_collision,
        show_frames,
        show_base_frame,
        show_end_effector_frame,
        show_cm,
        show_acm,
    ):

        visual = None
        collision = None
        collision_meshes = None
        attached_meshes = None
        frames = None
        base_frame = None
        ee_frame = None

        if robot:
            show_visual = True if show_visual is None else show_visual
            show_cm = True if show_cm is None else show_cm
            show_acm = True if show_acm is None else show_acm
            configuration = configuration or robot.zero_configuration()

            robot.update(configuration, visual=show_visual, collision=show_collision)
            compas_frames = robot.transformed_frames(configuration, group)

            if show_visual:
                visual = robot.artist.draw_visual()

            if show_collision:
                collision = robot.artist.draw_collision()

            if show_base_frame:
                base_compas_frame = compas_frames[0]
                artist = Artist(base_compas_frame)
                base_frame = artist.draw()

            if show_end_effector_frame:
                ee_compas_frame = robot.forward_kinematics(
                    configuration, group, options=dict(solver="model")
                )
                artist = Artist(ee_compas_frame)
                ee_frame = artist.draw()

            if show_frames:
                frames = []
                for compas_frame in compas_frames[1:]:
                    artist = Artist(compas_frame)
                    frame = artist.draw()
                    frames.append(frame)

            if show_cm or show_acm:
                scene = PlanningScene(robot)
                scene = robot.client.get_planning_scene()

                collision_meshes = []
                attached_meshes = []

                if show_cm:
                    for co in scene.world.collision_objects:
                        header = co.header
                        frame_id = header.frame_id
                        cms = co.to_collision_meshes()

                        for cm in cms:
                            if cm.frame != Frame.worldXY():
                                t = Transformation.from_frame(cm.frame)
                                mesh = cm.mesh.transformed(t)
                            else:
                                mesh = cm.mesh

                            collision_meshes.append(Artist(mesh).draw())

                if show_acm:
                    for aco in scene.robot_state.attached_collision_objects:
                        for acm in aco.to_attached_collision_meshes():
                            frame_id = aco.object["header"]["frame_id"]
                            frame = robot.forward_kinematics(
                                configuration, options=dict(link=frame_id)
                            )
                            t = Transformation.from_frame(frame)

                            # Local CM frame
                            if (
                                acm.collision_mesh.frame
                                and acm.collision_mesh.frame != Frame.worldXY()
                            ):
                                t = t * Transformation.from_frame(
                                    acm.collision_mesh.frame
                                )

                            mesh = acm.collision_mesh.mesh.transformed(t)

                            attached_meshes.append(Artist(mesh).draw())

        return (
            visual,
            collision,
            collision_meshes,
            attached_meshes,
            frames,
            base_frame,
            ee_frame,
        )
# ---------- end robot_visualize ----------
draw_3 = GhPythonScript(frames=[robot_visualize.ee_frame, robot_visualize.base_frame, robot_visualize.frames], scale=Slider(0.2, range=0..1))  # -> P, V, C, W; inputs frames: list
# ---------- draw_3: Python ----------
from System.Drawing import Color
from compas_ghpython.artists import FrameArtist

red = Color.FromArgb(255, 0, 0)
green = Color.FromArgb(0, 255, 0)
blue = Color.FromArgb(0, 0, 255)

P = []
V = []
C = []

scale = float(scale)

for plane in frames:
    if not plane:
        continue
    P += [plane.Origin] * 3
    V.append(plane.XAxis * scale)
    V.append(plane.YAxis * scale)
    V.append(plane.ZAxis * scale)
    C += [red, green, blue]

W = 3
# ---------- end draw_3 ----------
vdisex = VectorDisplayEx(Point=draw_3.P, Vector=draw_3.V, Colour=draw_3.C, Width=draw_3.W)

# ----
# Send joint values
button_3 = Button()
python_4 = GhPythonScript(configuration=branch, ros=ros_client, run=button_3, speed=number_slider)
# ---------- python_4: Python ----------
import compas_rrc as rrc
import math
abb = rrc.AbbClient(ros, '/rob1')
print('Connected.')

#external_axes = [0,0,0,0,0,0]
external_axes = []

if run : 
    robot_joints = [math.degrees(jv) for jv in configuration.joint_values]
    print("robot_joints =", robot_joints)
    abb.send_and_wait(rrc.MoveToJoints(robot_joints, external_axes, speed, rrc.Zone.Z10), timeout = 10)
# ---------- end python_4 ----------

current_element_key = Panel(idx)

# ----
# Pick n’ Place
# Brick top plane
# Points from curves
safety_distance = Slider(0.05, range=0..0.1)
t0cf_to_tcf = T0cfToTcf(G=pln_2)
t0cf_to_tcf_2 = T0cfToTcf(G=prot)
place_planes = Plane(draw_2.tool_planes_WCS)
pln_5 = Plane(t0cf_to_tcf_2)
pln_6 = Plane(t0cf_to_tcf)
home_vertical = Plane(pln_6)
pick_plane = Plane(pln_5)
sequence = GhPythonScript(pick_plane=pick_plane, place_planes=place_planes, home_vertical_plane=home_vertical, safety_distance=safety_distance)  # -> pick_sequence, place_sequence, all_pick_sequence, all_place_sequence; inputs place_planes: list
# ---------- sequence: Python ----------
from compas_rhino.conversions import RhinoPlane
from compas.geometry import Translation, Vector
from compas_ghpython.artists import FrameArtist
from compas_ghpython.utilities import list_to_ghtree

T = Translation.from_vector(Vector.Zaxis()*safety_distance)

pick_safety_frame = RhinoPlane.from_geometry(pick_plane).to_compas_frame().transformed(T) 
pick_safety_plane = FrameArtist(pick_safety_frame).draw()

all_pick_sequence = []
all_place_sequence = []

for place_plane in place_planes:
    place_safety_frame = RhinoPlane.from_geometry(place_plane).to_compas_frame().transformed(T) 
    place_safety_plane = FrameArtist(place_safety_frame).draw()
    
    pick_sequence = list([place_safety_plane, home_vertical_plane, pick_safety_plane, pick_plane])
    place_sequence = list([pick_safety_plane, home_vertical_plane, place_safety_plane, place_plane])
    
    all_pick_sequence.append(pick_sequence)
    all_place_sequence.append(place_sequence)

all_pick_sequence = list_to_ghtree(all_pick_sequence)
all_place_sequence = list_to_ghtree(all_place_sequence)
# ---------- end sequence ----------
run = Button()
tcf_to_t0cf = TcfToT0cf(G=sequence.all_place_sequence)
tcf_to_t0cf_2 = TcfToT0cf(G=sequence.all_pick_sequence)
send_to_robot = GhPythonScript(
    run=Toggle(False),
    send_elements=list_2,
    current_key=current_element_key,
    all_pick_sequence=tcf_to_t0cf_2,
    all_place_sequence=tcf_to_t0cf,
    ros=ros_client,
    speed=number_slider,
    collision_mesh=table_mesh)  # inputs current_key: Int32, all_pick_sequence: tree, all_place_sequence: tree, collision_mesh: Mesh
# ---------- send_to_robot: Python ----------
from compas_rhino.conversions import RhinoPlane, RhinoMesh
from compas.geometry import Scale, Frame
from compas_fab.robots import Robot
from compas_ghpython.utilities import ghtree_to_list
import compas_rrc as rrc
import time

all_pick_sequence = ghtree_to_list(all_pick_sequence)[0]
all_place_sequence = ghtree_to_list(all_place_sequence)[0]

if send_elements == "current":
    all_pick_sequence = list([all_pick_sequence[current_key]])
    all_place_sequence = list([all_place_sequence[current_key]])

abb = rrc.AbbClient(ros, '/rob1')
print('Connected.')

if run :
    # Set tool
    abb.send(rrc.SetTool('tool0'))
    # Set work object
    abb.send(rrc.SetWorkObject('wobj0'))
    
    for i in range(len(all_place_sequence)-1):
        
        frames_place = []
        frames_pick = []
        
        #close gripper
        abb.send_and_wait(rrc.SetDigital('ABB_Scalable_IO_0_DO16', 0), timeout=5)
        abb.send_and_wait(rrc.WaitTime(1))
        
        #send the place sequence
        for plane_place in all_place_sequence[i]:
            frame_place = RhinoPlane.from_geometry(plane_place).to_compas_frame()
            abb.send_and_wait(rrc.MoveToFrame(frame_place, speed, rrc.Zone.FINE, rrc.Motion.LINEAR), timeout=10)
        
        #open gripper
        abb.send_and_wait(rrc.SetDigital('ABB_Scalable_IO_0_DO16', 1), timeout=5)
        
        #send the pick sequence
        for plane_pick in all_pick_sequence[i]:
            frame_pick = RhinoPlane.from_geometry(plane_pick).to_compas_frame()
            abb.send_and_wait(rrc.MoveToFrame(frame_pick, speed, rrc.Zone.FINE, rrc.Motion.LINEAR), timeout=10)
# ---------- end send_to_robot ----------

# ----
# Send frame
button_4 = Button()
tcf_to_t0cf_3 = TcfToT0cf(G=pick_plane)
python_5 = GhPythonScript(planes=tcf_to_t0cf_3, ros=ros_client, run=button_4, speed=number_slider)  # inputs planes: list
# ---------- python_5: Python ----------
from compas_rhino.conversions import RhinoPlane
import compas_rrc as rrc
abb = rrc.AbbClient(ros, '/rob1')
print('Connected.')

frames = []

if run : 

    for plane in planes :
        frames.append(RhinoPlane.from_geometry(plane).to_compas_frame())
    
    # Set tool
    abb.send(rrc.SetTool('tool0'))

    # Set work object
    abb.send(rrc.SetWorkObject('wobj0'))
    
    for frame in frames: 
        abb.send_and_wait(rrc.MoveToFrame(frame, speed, rrc.Zone.FINE, rrc.Motion.LINEAR), timeout = 10)
# ---------- end python_5 ----------

robot_2 = Data(tool)
pic = Point(Point(555.7245114, -90.66801086, 88.05020889))
pt_3 = Point(Point(402.0112129, 124.9922568, 172.1572585))
xy = XYPlane(Origin=pt_3)
xy_2 = XYPlane(Origin=pic)
zero_config_2 = ZeroConfig(robot=robot_2)  # -> config; same code as zero_config
place_frame = GhPythonScript(plane=xy)  # -> frame
# ---------- place_frame: Python ----------
__author__ = "grangeot"

from compas.geometry import Frame

frame = Frame(plane.Origin, plane.XAxis, plane.YAxis)
# ---------- end place_frame ----------
pick_frame = GhPythonScript(plane=xy_2)  # -> frame; same code as place_frame
number_slider_2 = Slider(10, range=0..10)
list_4 = ValueList({"start config": 0, "approach pick config": 1, "pick config": 2, "approach place config": 3, "place config": 4, "pick path": 5, "place path": 6, "free space path": 7, "start path": 8, "full path": 9}, selected="full path")

# ----
# Pick
python_6 = GhPythonScript(pick_frame=pick_frame, approach_vector=approach_vector.vector)  # -> approach_pick_frame
# ---------- python_6: Python ----------
from compas.geometry import Translation

approach_pick_frame = pick_frame.transformed(Translation.from_vector(approach_vector))
# ---------- end python_6 ----------
ik_2 = InverseKinematics(robot=robot_2, plane=python_6, start_configuration=zero_config_2)  # -> configuration
#   port plane: The plane or frame to calculate the inverse kinematic for.
#   port start_configuration: If passed, calculates the inverse such that the joint positions differ the least from the start_configuration. Defaults to the zero configuration.
#   port group: The planning group used for calculation. Defaults to the robot's main planning group.
#   port configuration: The planning group's configuration.
# ---------- ik_2: Python ----------
"""
Calculate the robot's inverse kinematic for a given plane.

COMPAS FAB v0.27.0
"""
from compas_rhino.conversions import RhinoPlane
from ghpythonlib.componentbase import executingcomponent as component


class InverseKinematics(component):
    def RunScript(self, robot, plane, start_configuration, group):
        configuration = None
        if robot and robot.client and robot.client.is_connected and plane:
            frame = RhinoPlane.from_geometry(plane).to_compas_frame()
            configuration = robot.inverse_kinematics(frame, start_configuration, group)
        return configuration
# ---------- end ik_2 ----------
ik_3 = InverseKinematics(robot=robot_2, plane=pick_frame, start_configuration=ik_2)  # -> configuration; same code as ik_2

# ----
# Place
python_7 = GhPythonScript(place_frame=place_frame, approach_vector=approach_vector.vector)  # -> approach_place_frame
# ---------- python_7: Python ----------
from compas.geometry import Translation

approach_place_frame = place_frame.transformed(Translation.from_vector(approach_vector))
# ---------- end python_7 ----------
ik_4 = InverseKinematics(robot=robot_2, plane=python_7, start_configuration=ik_2)  # -> configuration; same code as ik_2
ik_5 = InverseKinematics(robot=robot_2, plane=place_frame, start_configuration=ik_4)  # -> configuration; same code as ik_2

ik_6 = InverseKinematics(robot=robot_2, plane=python_7, start_configuration=ik_2)  # -> configuration; same code as ik_2

# ----
# Place path
merge = Merge(Data1=python_7, Data2=place_frame, Data3=python_7)
plan_cartesian_motion = PlanCartesianMotion(robot=robot_2, planes=merge, start_configuration=ik_4, max_step=number_slider_2, compute=Button())  # -> trajectory; inputs planes: list, attached_collision_meshes: list, path_constraints: list, compute: Boolean
#   port planes: The planes or frames through which the path is defined.
#   port start_configuration: The robot's full configuration, i.e. values for all configurable joints of the entire robot, at the starting position. Defaults to the all-zero configuration.
#   port group: The planning group used for calculation. Defaults to the robot's main planning group.
#   port attached_collision_meshes: A list of attached collision meshes to be included for planning.
#   port path_constraints: Optional constraints that can be imposed along the solution path. Note that path calculation won't work if the start_configuration violates these constraints. Defaults to None.
#   port max_step: The approximate distance between the calculated points. (Defined in the robot's units.) Defaults to 0.01.
#   port compute: If True, calculates a trajectory.
#   port trajectory: The calculated trajectory.
# ---------- plan_cartesian_motion: Python ----------
"""
Calculate a cartesian motion path (linear in tool space).

COMPAS FAB v0.27.0
"""
from compas_rhino.conversions import RhinoPlane
from ghpythonlib.componentbase import executingcomponent as component
from scriptcontext import sticky as st

from compas_fab.ghpython.components import create_id


class PlanCartesianMotion(component):
    def RunScript(self, robot, planes, start_configuration, group, attached_collision_meshes, path_constraints, max_step, compute):

        key = create_id(self, 'trajectory')

        max_step = float(max_step) if max_step else 0.01
        path_constraints = list(path_constraints) if path_constraints else None
        attached_collision_meshes = list(attached_collision_meshes) if attached_collision_meshes else None

        if robot and robot.client and robot.client.is_connected and start_configuration and planes and compute:
            frames = [RhinoPlane.from_geometry(plane).to_compas_frame() for plane in planes]
            st[key] = robot.plan_cartesian_motion(frames,
                                                  start_configuration=start_configuration,
                                                  group=group,
                                                  options=dict(
                                                      max_step=max_step,
                                                      path_constraints=path_constraints,
                                                      attached_collision_meshes=attached_collision_meshes
                                                  ))

        trajectory = st.get(key, None)
        return trajectory
# ---------- end plan_cartesian_motion ----------
trajectory_visualize = TrajectoryVisualize(robot=robot_2, trajectory=plan_cartesian_motion)  # -> start_configuration, configurations, fraction, time, planes, P, V, A
#   port group: The planning group for which this trajectory was planned.
#   port trajectory: The calculated trajectory.
#   port start_configuration: The start configuration of the trajectory.
#   port configurations: The full configurations along the trajectory.
#   port fraction: Indicates the fraction of requested trajectory that was calculated, e.g. 1 means the full trajectory was found.
#   port time: The time which is needed to execute that trajectory at full speed.
#   port planes: The planes of the robot's end-effector.
#   port P: The positions along the trajectory
#   port V: The velocities along the trajectory
#   port A: The accelerations along the trajectory
# ---------- trajectory_visualize: Python ----------
"""
Visualizes a trajectory.

COMPAS FAB v0.22.0
"""
from compas_ghpython import draw_frame
from compas_ghpython import list_to_ghtree
from ghpythonlib.componentbase import executingcomponent as component


class TrajectoryVisualize(component):
    def RunScript(self, robot, group, trajectory):
        start_configuration = None
        configurations = []
        fraction = 0.
        time = 0.

        planes = []
        positions = []
        velocities = []
        accelerations = []

        if robot and trajectory:
            group = group or robot.main_group_name

            for c in trajectory.points:
                configurations.append(robot.merge_group_with_full_configuration(c, trajectory.start_configuration, group))
                frame = robot.forward_kinematics(c, group, options=dict(solver='model'))
                planes.append(draw_frame(frame))
                positions.append(c.positions)
                velocities.append(c.velocities)
                accelerations.append(c.accelerations)

            start_configuration = trajectory.start_configuration
            fraction = trajectory.fraction
            time = trajectory.time_from_start

        P = list_to_ghtree(list(zip(*positions)))
        V = list_to_ghtree(list(zip(*velocities)))
        A = list_to_ghtree(list(zip(*accelerations)))

        # return outputs if you have them; here I try it for you:
        return (start_configuration, configurations, fraction, time, planes, P, V, A)
# ---------- end trajectory_visualize ----------
item = ListItem(List=trajectory_visualize.configurations, Index=Slider(0, range=0..100), Wrap=True)

# ----
# Free space path - between pick and place
constraint_from_config = GhPythonScript(robot=robot_2, config=ik_4, tolerance_joint=tolerance_deg)  # -> constraints
# ---------- constraint_from_config: Python ----------
import math

if robot and config:
    TOLERANCE_JOINTS = [math.radians(tolerance_joint)] * len(robot.get_configurable_joints())
    constraints = robot.constraints_from_configuration(config, 
                                                       tolerances_above=TOLERANCE_JOINTS,
                                                       tolerances_below=TOLERANCE_JOINTS)
# ---------- end constraint_from_config ----------
plan_motion = PlanMotion(robot=robot_2, goal_constraints=constraint_from_config, start_configuration=ik_2, compute=Button())  # -> trajectory; inputs goal_constraints: list, attached_collision_meshes: list, path_constraints: list, compute: Boolean
#   port goal_constraints: The goal to be achieved, defined in a set of constraints. Constraints can be very specific, for example defining value domains for each joint, such that the goal configuration is included, or defining a volume in space, to which a specific robot link (e.g. the end-effector) is required to move to.
#   port start_configuration: The robot's full configuration, i.e. values for all configurable joints of the entire robot, at the starting position. Defaults to the all-zero configuration.
#   port group: The planning group used for calculation. Defaults to the robot's main planning group.
#   port attached_collision_meshes: A list of attached collision meshes to be included for planning.
#   port path_constraints: Optional constraints that can be imposed along the solution path. Note that path calculation won't work if the start_configuration violates these constraints. Defaults to None.
#   port planner_id: The name of the algorithm used for path planning. Defaults to 'RRTConnectkConfigDefault'
#   port compute: If True, calculates a trajectory.
#   port trajectory: The calculated trajectory.
# ---------- plan_motion: Python ----------
"""
Calculate a motion path.

COMPAS FAB v0.22.0
"""
from ghpythonlib.componentbase import executingcomponent as component
from scriptcontext import sticky as st

from compas_fab.ghpython.components import create_id


class PlanMotion(component):
    def RunScript(self, robot, goal_constraints, start_configuration, group, attached_collision_meshes, path_constraints, planner_id, compute):

        key = create_id(self, 'trajectory')

        path_constraints = list(path_constraints) if path_constraints else None
        attached_collision_meshes = list(attached_collision_meshes) if attached_collision_meshes else None
        planner_id = str(planner_id) if planner_id else 'RRTConnectkConfigDefault'

        if robot and robot.client and robot.client.is_connected and start_configuration and goal_constraints and compute:
            st[key] = robot.plan_motion(goal_constraints,
                                        start_configuration=start_configuration,
                                        group=group,
                                        options=dict(
                                            attached_collision_meshes=attached_collision_meshes,
                                            path_constraints=path_constraints,
                                            planner_id=planner_id,
                                        ))

        trajectory = st.get(key, None)
        return trajectory
# ---------- end plan_motion ----------
trajectory_visualize_2 = TrajectoryVisualize(robot=robot_2, trajectory=plan_motion)  # -> start_configuration, configurations, fraction, time, planes, P, V, A; same code as trajectory_visualize
item_2 = ListItem(List=trajectory_visualize_2.configurations, Index=Slider(0, range=0..100), Wrap=True)

# ----
# Start path
constraint_from_config_2 = GhPythonScript(robot=robot_2, config=ik_2, tolerance_joint=tolerance_deg)  # -> constraints; same code as constraint_from_config
plan_motion_2 = PlanMotion(robot=robot_2, goal_constraints=constraint_from_config_2, start_configuration=zero_config_2, compute=Button())  # -> trajectory; inputs goal_constraints: list, attached_collision_meshes: list, path_constraints: list, compute: Boolean; same code as plan_motion
trajectory_visualize_3 = TrajectoryVisualize(robot=robot_2, trajectory=plan_motion_2)  # -> start_configuration, configurations, fraction, time, planes, P, V, A; same code as trajectory_visualize
item_3 = ListItem(List=trajectory_visualize_3.configurations, Index=Slider(0, range=0..100), Wrap=True)

# ----
# Pick path
merge_2 = Merge(Data1=python_6, Data2=pick_frame, Data3=python_6)
plan_cartesian_motion_2 = PlanCartesianMotion(robot=robot_2, planes=merge_2, start_configuration=ik_2, max_step=number_slider_2, compute=Button())  # -> trajectory; inputs planes: list, attached_collision_meshes: list, path_constraints: list, compute: Boolean; same code as plan_cartesian_motion

# ---- group: Merging all paths in correct sequence
merge_paths = GhPythonScript(
    start_trajectory=plan_motion_2,
    pick_trajectory=plan_cartesian_motion_2,
    freespace_trajectory=plan_motion,
    place_trajectory=plan_cartesian_motion)  # -> configurations
# ---------- merge_paths: Python ----------
configurations = start_trajectory.points + \
                 pick_trajectory.points + \
                 freespace_trajectory.points + \
                 place_trajectory.points
# ---------- end merge_paths ----------
item_4 = ListItem(List=merge_paths, Index=Slider(0, range=0..48), Wrap=True)

# ----
trajectory_visualize_4 = TrajectoryVisualize(robot=robot_2, trajectory=plan_cartesian_motion_2)  # -> start_configuration, configurations, fraction, time, planes, P, V, A
#   port group: The planning group for which this trajectory was planned.
#   port trajectory: The calculated trajectory.
#   port start_configuration: The start configuration of the trajectory.
#   port configurations: The full configurations along the trajectory.
#   port fraction: Indicates the fraction of requested trajectory that was calculated, e.g. 1 means the full trajectory was found.
#   port time: The time which is needed to execute that trajectory at full speed.
#   port planes: The planes of the robot's end-effector.
#   port P: The positions along the trajectory
#   port V: The velocities along the trajectory
#   port A: The accelerations along the trajectory
# ---------- trajectory_visualize_4: Python ----------
"""
Visualizes a trajectory.

COMPAS FAB v0.27.0
"""
from compas_ghpython import draw_frame
from compas_ghpython import list_to_ghtree
from ghpythonlib.componentbase import executingcomponent as component


class TrajectoryVisualize(component):
    def RunScript(self, robot, group, trajectory):
        start_configuration = None
        configurations = []
        fraction = 0.
        time = 0.

        planes = []
        positions = []
        velocities = []
        accelerations = []

        if robot and trajectory:
            group = group or robot.main_group_name

            for c in trajectory.points:
                configurations.append(robot.merge_group_with_full_configuration(c, trajectory.start_configuration, group))
                frame = robot.forward_kinematics(c, group, options=dict(solver='model'))
                planes.append(draw_frame(frame))
                positions.append(c.positions)
                velocities.append(c.velocities)
                accelerations.append(c.accelerations)

            start_configuration = trajectory.start_configuration
            fraction = trajectory.fraction
            time = trajectory.time_from_start

        P = list_to_ghtree(list(zip(*positions)))
        V = list_to_ghtree(list(zip(*velocities)))
        A = list_to_ghtree(list(zip(*accelerations)))

        # return outputs if you have them; here I try it for you:
        return (start_configuration, configurations, fraction, time, planes, P, V, A)
# ---------- end trajectory_visualize_4 ----------

item_5 = ListItem(List=trajectory_visualize_4.configurations, Index=Slider(25, range=0..100), Wrap=True)

filter = StreamFilter(
    Gate=list_4,
    Stream0=zero_config_2,
    Stream1=ik_2,
    Stream2=ik_3,
    Stream3=ik_4,
    Stream4=ik_5,
    Stream5=item_5,
    Stream6=item,
    Stream7=item_2,
    Stream8=item_3,
    Stream9=item_4)

# ==== cluster T0cfToTcf
G = ClusterInput()
scale = Scale(Geometry=G, Center=Point(0, 0, 0), Factor="0.001")  # -> Geometry, Transform
rotate = Rotate(Geometry=scale.Geometry, Angle=degrees("45"), Plane=scale.Geometry)  # -> Geometry, Transform
deplane = DeconstructPlane(Plane=rotate.Geometry)  # -> Origin, XAxis, YAxis, ZAxis
amp = Amplitude(Vector=deplane.ZAxis, Amplitude="0.1534")
move = Move(Geometry=rotate.Geometry, Motion=amp)  # -> Geometry, Transform
G_2 = ClusterOutput(move.Geometry)

# ==== cluster TcfToT0cf
G = ClusterInput()
rotate = Rotate(Geometry=G, Angle=degrees("45"), Plane=G)  # -> Geometry, Transform
deplane = DeconstructPlane(Plane=rotate.Geometry)  # -> Origin, XAxis, YAxis, ZAxis
rev = Reverse(Vector=deplane.ZAxis)
amp = Amplitude(Vector=rev, Amplitude="0.1534")
move = Move(Geometry=rotate.Geometry, Motion=amp)  # -> Geometry, Transform
scale = Scale(Geometry=move.Geometry, Center=Point(0, 0, 0), Factor="1000")  # -> Geometry, Transform
G_2 = ClusterOutput(scale.Geometry)

# ==== cluster Cluster
rec = ClusterInput()
rec_2 = ClusterInput()
rec_3 = DataRecorder(rec, DataLimit=-10, RecordData=True)
rec_4 = DataRecorder(simplify(flatten(rec_2)), DataLimit=-10, RecordData=True)
clean = CleanTree(RemoveNulls=True, RemoveInvalid=True, RemoveEmpty=False, Tree=flatten(rec_4))
clean_2 = CleanTree(RemoveNulls=True, RemoveInvalid=True, RemoveEmpty=False, Tree=rec_3)
item = ListItem(List=clean, Index="-1", Wrap=True)
item_2 = ListItem(List=clean_2, Index="-1", Wrap=True)
configuration = Data(item)
draw = Draw(cg=item_2)  # -> rg
#   port cg: The COMPAS geometry or datastructure to be drawn.
#   port rg: The Rhino geometry object.
# ---------- draw: Python ----------
"""
Draws COMPAS geometry in Grasshopper.
"""
from ghpythonlib.componentbase import executingcomponent as component

from compas.artists import Artist


class CompasToRhinoGeometry(component):
    def RunScript(self, cg):
        if not cg:
            return None

        return Artist(cg).draw()
# ---------- end draw ----------
python = GhPythonScript(frame=item_2)  # -> out, plane
# ---------- python: Python ----------
import compas_rhino.conversions
import compas.artists
import compas_ghpython as cp

plane = cp.draw_frame(frame)
# ---------- end python ----------
configuration_2 = ClusterOutput(configuration)
plane = ClusterOutput(draw)
